# Grasshopper definition 1202_ECbyLayer.gh (Grasshopper 1.0.7)
# plug-ins: Human UI

panel = Panel("E:\Grad School\OneDrive - Harvard University\SCI6372\ICE DB V3.0\Testcsv1121.csv")
file = ReadFile(File=panel, PerLineParse=True)
file_2 = ReadFile(File=panel, PerLineParse=True)
c_script = CSharpScript(data=file_2)  # -> out, Material, SubMaterial, MaterialDetail, UnitOfDeclaredUnit, WeightPerDeclaredUnit_kg, DensityOfMaterial_kgPERm3, EmbodiedCarbon_kgPERunit, EmbodiedCarbon_kgPERkg; inputs data: list of String
# ---------- c_script: C# usings ----------
using System.IO;
using System.Linq;
using System.Data;
using System.Drawing;
using System.Reflection;
using System.Windows.Forms;
using System.Xml;
using System.Xml.Linq;
using System.Runtime.InteropServices;

using Rhino.DocObjects;
using Rhino.Collections;
using GH_IO;
using GH_IO.Serialization;
# ---------- c_script: C# ----------
    //get material, submaterial, unit of declared unit, weight per declared unit, density, Embodied carbon, Embodied Carbon per kg
    //string is used split up the content in to indivisual lists at this point, since most of the columns contain both numbers and string
    //can convert the data to proper variable types during math operations later
    List<string> material = new List<string>();
    List<string> subMaterial = new List<string>();
    List<string> materialDetail = new List <string>();
    List<string> unitOfDeclaredUnit = new List<string>();
    List<string> weightPerDeclaredUnit_kg = new List<string>();
    List<string> densityOfMaterial_kgPERm3 = new List<string>();
    List<string> embodiedCarbon_kgPERunit = new List<string>();
    List<string> embodiedCarbon_kgPERkg = new List<string>();

    for (int i = 1; i < data.Count; i++) {
      //retrieve data
      string dataRow = data[i];

      // https://docs.microsoft.com/en-us/dotnet/api/system.string.split?view=netframework-4.5
      string[] dataColumns = dataRow.Split(',');

      //add content to list
      string mt = dataColumns[0];
      string smt = dataColumns[1];
      string md = dataColumns[2];
      string uodu = dataColumns[3];
      string wpdu_kg = dataColumns[4];
      string dom_kgPERm3 = dataColumns[5];
      string ec_kgPERunit = dataColumns[6];
      string ec_kgPERkg = dataColumns[7];

      material.Add(mt);
      subMaterial.Add(smt);
      materialDetail.Add(md);
      unitOfDeclaredUnit.Add(uodu);

      weightPerDeclaredUnit_kg.Add(wpdu_kg);
      densityOfMaterial_kgPERm3.Add(dom_kgPERm3);
      embodiedCarbon_kgPERunit.Add(ec_kgPERunit);
      embodiedCarbon_kgPERkg.Add(ec_kgPERkg);

    }

    // output
    Material = material;
    SubMaterial = subMaterial;
    UnitOfDeclaredUnit = unitOfDeclaredUnit;
    MaterialDetail = materialDetail;
    WeightPerDeclaredUnit_kg = weightPerDeclaredUnit_kg;
    DensityOfMaterial_kgPERm3 = densityOfMaterial_kgPERm3;
    EmbodiedCarbon_kgPERunit = embodiedCarbon_kgPERunit;
    EmbodiedCarbon_kgPERkg = embodiedCarbon_kgPERkg;
# ---------- end c_script ----------
panel_2 = Panel(c_script.Material)
panel_3 = Panel(c_script.SubMaterial)
panel_4 = Panel(c_script.MaterialDetail)
panel_5 = Panel(c_script.UnitOfDeclaredUnit)
panel_6 = Panel(c_script.WeightPerDeclaredUnit_kg)
panel_7 = Panel(c_script.DensityOfMaterial_kgPERm3)
panel_8 = Panel(c_script.EmbodiedCarbon_kgPERunit)
c_script_2 = CSharpScript(layerName="Glass")  # -> A; inputs layerName: String
# ---------- c_script_2: C# ----------
    //reference: https://discourse.mcneel.com/t/c-select-objects-by-layer/84420
    Rhino.DocObjects.RhinoObject[] rhino_objs = doc.Objects.FindByLayer(layerName);
    List<object> grasshopper_objs = new List<object>();
    foreach (Rhino.DocObjects.RhinoObject ro in rhino_objs)
      grasshopper_objs.Add(ro.Geometry);
    A = grasshopper_objs;
# ---------- end c_script_2 ----------
c_script_3 = CSharpScript(layerName="Wood")  # -> A; inputs layerName: String; same code as c_script_2
c_script_4 = CSharpScript(layerName="Concrete")  # -> A; inputs layerName: String; same code as c_script_2
panel_9 = Panel(c_script.EmbodiedCarbon_kgPERkg)
entwine = Entwine(Branch0X=c_script_4, Branch1X=c_script_2, Branch2X=c_script_3, FlattenInputs=False)
c_script_5 = CSharpScript(enclosed_brep=c_script_4)  # -> out, V; inputs enclosed_brep: list of Brep
# ---------- c_script_5: C# ----------
    double total_volume = 0;

    for (int i = 0; i < enclosed_brep.Count;i++){
      total_volume = total_volume + enclosed_brep[i].GetVolume();
    }

    V = total_volume;
# ---------- end c_script_5 ----------
c_script_6 = CSharpScript(enclosed_brep=c_script_2)  # -> out, V; inputs enclosed_brep: list of Brep; same code as c_script_5
c_script_7 = CSharpScript(enclosed_brep=c_script_3)  # -> out, V; inputs enclosed_brep: list of Brep; same code as c_script_5
number_slider = Slider(800, range=0..1000)
c_script_8 = CSharpScript(data=file, mtl="Glass")  # -> out, sub_mtl; inputs data: list of String, mtl: String
# ---------- c_script_8: C# ----------
    //get material, submaterial, unit of declared unit, weight per declared unit, density, Embodied carbon, Embodied Carbon per kg
    //string is used split up the content in to indivisual lists at this point, since most of the columns contain both numbers and string
    //can convert the data to proper variable types during math operations later
    List<string> material = new List<string>();
    List<string> subMaterial = new List<string>();
    List<string> materialDetail = new List <string>();
    List<string> unitOfDeclaredUnit = new List<string>();
    List<string> weightPerDeclaredUnit_kg = new List<string>();
    List<string> densityOfMaterial_kgPERm3 = new List<string>();
    List<string> embodiedCarbon_kgPERunit = new List<string>();
    List<string> embodiedCarbon_kgPERkg = new List<string>();

    for (int i = 1; i < data.Count; i++) {
      //retrieve data
      string dataRow = data[i];

      // https://docs.microsoft.com/en-us/dotnet/api/system.string.split?view=netframework-4.5
      string[] dataColumns = dataRow.Split(',');

      //add content to list
      string mt = dataColumns[0];
      string smt = dataColumns[1];
      string md = dataColumns[2];
      string uodu = dataColumns[3];
      string wpdu_kg = dataColumns[4];
      string dom_kgPERm3 = dataColumns[5];
      string ec_kgPERunit = dataColumns[6];
      string ec_kgPERkg = dataColumns[7];

      material.Add(mt);
      subMaterial.Add(smt);
      materialDetail.Add(md);
      unitOfDeclaredUnit.Add(uodu);

      weightPerDeclaredUnit_kg.Add(wpdu_kg);
      densityOfMaterial_kgPERm3.Add(dom_kgPERm3);
      embodiedCarbon_kgPERunit.Add(ec_kgPERunit);
      embodiedCarbon_kgPERkg.Add(ec_kgPERkg);

    }

    // sorting
    List<string> material_name = new List<string>();
    List<string> _AggregateSand = new List<string>();
    List<string> _Aluminum = new List<string>();
    List<string> _Asphalt = new List<string>();
    List<string> _Bitumen = new List<string>();
    List<string> _Cement = new List<string>();
    List<string> _Clay = new List<string>();
    List<string> _Concrete = new List<string>();
    List<string> _Glass = new List<string>();
    List<string> _Steel = new List<string>();
    List<string> _Timber = new List<string>();

    for (int i = 0; i < materialDetail.Count - 4; i++)
    {
      if (materialDetail[i] != "-")
      {
        if (materialDetail[i].Substring(0, 3) == "Agg")
        {
          _AggregateSand.Add(materialDetail[i]);
        }
        else if (materialDetail[i].Substring(0, 3) == "Alu" || materialDetail[i].Substring(0, 3) == "alu")
        {
          _Aluminum.Add(materialDetail[i]);
        }
        else if (materialDetail[i].Substring(0, 3) == "Asp" || materialDetail[i].Substring(0, 3) == "asp")
        {
          _Asphalt.Add(materialDetail[i]);
        }
        else if (materialDetail[i].Substring(0, 3) == "Bit" || materialDetail[i].Substring(0, 3) == "bit")
        {
          _Bitumen.Add(materialDetail[i]);
        }
        else if (materialDetail[i].Substring(0, 3) == "Cem" || materialDetail[i].Substring(0, 3) == "cem")
        {
          _Cement.Add(materialDetail[i]);
        }
        else if (materialDetail[i].Substring(0, 3) == "Cla" || materialDetail[i].Substring(0, 3) == "cla")
        {
          _Clay.Add(materialDetail[i]);
        }
        else if (materialDetail[i].Substring(0, 3) == "Con" || materialDetail[i].Substring(0, 3) == "con")
        {
          _Concrete.Add(materialDetail[i]);
        }
        else if (materialDetail[i].Substring(0, 3) == "Gla" || materialDetail[i].Substring(0, 3) == "gla")
        {
          _Glass.Add(materialDetail[i]);
        }
        else if (materialDetail[i].Substring(0, 3) == "Ste" || materialDetail[i].Substring(0, 3) == "ste")
        {
          _Steel.Add(materialDetail[i]);
        }
        else if (materialDetail[i].Substring(0, 3) == "Tim" || materialDetail[i].Substring(0, 3) == "tim")
        {
          _Timber.Add(materialDetail[i]);
        }
      }

    }


    if (mtl == "AggregateSand")
    {
      sub_mtl = _AggregateSand;
    }
    else if (mtl == "Aluminum")
    {
      sub_mtl = _Aluminum;
    }
    else if (mtl == "Asphalt")
    {
      sub_mtl = _Asphalt;
    }
    else if (mtl == "Bitumen")
    {
      sub_mtl = _Bitumen;
    }
    else if (mtl == "Cement")
    {
      sub_mtl = _Cement;
    }
    else if (mtl == "Clay")
    {
      sub_mtl = _Clay;
    }
    else if (mtl == "Concrete")
    {
      sub_mtl = _Concrete;
    }
    else if (mtl == "Glass")
    {
      sub_mtl = _Glass;
    }
    else if (mtl == "Steel")
    {
      sub_mtl = _Steel;
    }
    else if (mtl == "Timber")
    {
      sub_mtl = _Timber;
    }
# ---------- end c_script_8 ----------
c_script_9 = CSharpScript(data=file, mtl="Concrete")  # -> out, sub_mtl; inputs data: list of String, mtl: String; same code as c_script_8
c_script_10 = CSharpScript(data=file, mtl="Timber")  # -> out, sub_mtl; inputs data: list of String, mtl: String; same code as c_script_8
launch_window = LaunchWindow(
    Show=Toggle(True),
    Name="Control Window",
    Width=number_slider,
    Height=number_slider,
    ChildStatus=0,
    EnableHorizScroll=False)
create_pulldown_menu = CreatePulldownMenu(Label="Material Detail", ListItems=c_script_9.sub_mtl, SelectedIndex="0", showLabel=True)
create_pulldown_menu_2 = CreatePulldownMenu(Label="Material Detail", ListItems=c_script_8.sub_mtl, SelectedIndex="0", showLabel=True)
create_pulldown_menu_3 = CreatePulldownMenu(Label="Wood", ListItems=c_script_10.sub_mtl, SelectedIndex="0", showLabel=True)
set_window_properties = SetWindowProperties(Window=launch_window, AccentColor="red", ShowTitleBar=True, ScaleFactor=1)
value_listener = ValueListener(Elements=create_pulldown_menu, SomeProperty=True)  # -> Values, Indices
c_script_11 = CSharpScript(data=file, V=c_script_5.V, mtl=value_listener.Values)  # -> out, flatten(EC), EC_m2; inputs data: list of String, V: Double, mtl: String
# ---------- c_script_11: C# ----------
    //get material, submaterial, unit of declared unit, weight per declared unit, density, Embodied carbon, Embodied Carbon per kg
    //string is used split up the content in to indivisual lists at this point, since most of the columns contain both numbers and string
    //can convert the data to proper variable types during math operations later
    List<string> material = new List<string>();
    List<string> subMaterial = new List<string>();
    List<string> materialDetail = new List <string>();
    List<string> unitOfDeclaredUnit = new List<string>();
    List<string> weightPerDeclaredUnit_kg = new List<string>();
    List<string> densityOfMaterial_kgPERm3 = new List<string>();
    List<string> embodiedCarbon_kgPERunit = new List<string>();
    List<string> embodiedCarbon_kgPERkg = new List<string>();

    for (int i = 1; i < data.Count; i++) {
      //retrieve data
      string dataRow = data[i];

      // https://docs.microsoft.com/en-us/dotnet/api/system.string.split?view=netframework-4.5
      string[] dataColumns = dataRow.Split(',');

      //add content to list
      string mt = dataColumns[0];
      string smt = dataColumns[1];
      string md = dataColumns[2];
      string uodu = dataColumns[3];
      string wpdu_kg = dataColumns[4];
      string dom_kgPERm3 = dataColumns[5];
      string ec_kgPERunit = dataColumns[6];
      string ec_kgPERkg = dataColumns[7];

      material.Add(mt);
      subMaterial.Add(smt);
      materialDetail.Add(md);
      unitOfDeclaredUnit.Add(uodu);

      weightPerDeclaredUnit_kg.Add(wpdu_kg);
      densityOfMaterial_kgPERm3.Add(dom_kgPERm3);
      embodiedCarbon_kgPERunit.Add(ec_kgPERunit);
      embodiedCarbon_kgPERkg.Add(ec_kgPERkg);

    }

    // sorting
    List<string> material_name = new List<string>();
    List<string> AggregateSand = new List<string>();
    List<string> Aluminum = new List<string>();
    List<string> Ashphalt = new List<string>();
    List<string> Bitumen = new List<string>();
    List<string> Cement = new List<string>();
    List<string> Clay = new List<string>();
    List<string> Concrete = new List<string>();
    List<string> Glass = new List<string>();
    List<string> Steel = new List<string>();
    List<string> Timber = new List<string>();




    //testing calculation of material by volume
    double calculatedEC = 0;
    //double volume = buildingpart.GetVolume();
    for (int i = 0; i < subMaterial.Count; i++){
      if (materialDetail[i] == mtl)
      {
        calculatedEC = Convert.ToDouble(densityOfMaterial_kgPERm3[i]) * V * Convert.ToDouble(embodiedCarbon_kgPERkg[i]);
      }

    }

    // output
    EC = calculatedEC;
    EC_m2 = calculatedEC / V;
# ---------- end c_script_11 ----------
value_listener_2 = ValueListener(Elements=create_pulldown_menu_2, SomeProperty=True)  # -> Values, Indices
c_script_12 = CSharpScript(data=file, V=c_script_6.V, mtl=value_listener_2.Values)  # -> out, flatten(EC), EC_m2; inputs data: list of String, V: Double, mtl: String
# ---------- c_script_12: C# ----------
    //get material, submaterial, unit of declared unit, weight per declared unit, density, Embodied carbon, Embodied Carbon per kg
    //string is used split up the content in to indivisual lists at this point, since most of the columns contain both numbers and string
    //can convert the data to proper variable types during math operations later
    List<string> material = new List<string>();
    List<string> subMaterial = new List<string>();
    List<string> materialDetail = new List <string>();
    List<string> unitOfDeclaredUnit = new List<string>();
    List<string> weightPerDeclaredUnit_kg = new List<string>();
    List<string> densityOfMaterial_kgPERm3 = new List<string>();
    List<string> embodiedCarbon_kgPERunit = new List<string>();
    List<string> embodiedCarbon_kgPERkg = new List<string>();

    for (int i = 1; i < data.Count; i++) {
      //retrieve data
      string dataRow = data[i];

      // https://docs.microsoft.com/en-us/dotnet/api/system.string.split?view=netframework-4.5
      string[] dataColumns = dataRow.Split(',');

      //add content to list
      string mt = dataColumns[0];
      string smt = dataColumns[1];
      string md = dataColumns[2];
      string uodu = dataColumns[3];
      string wpdu_kg = dataColumns[4];
      string dom_kgPERm3 = dataColumns[5];
      string ec_kgPERunit = dataColumns[6];
      string ec_kgPERkg = dataColumns[7];

      material.Add(mt);
      subMaterial.Add(smt);
      materialDetail.Add(md);
      unitOfDeclaredUnit.Add(uodu);

      weightPerDeclaredUnit_kg.Add(wpdu_kg);
      densityOfMaterial_kgPERm3.Add(dom_kgPERm3);
      embodiedCarbon_kgPERunit.Add(ec_kgPERunit);
      embodiedCarbon_kgPERkg.Add(ec_kgPERkg);

    }

    // sorting
    List<string> material_name = new List<string>();
    List<string> AggregateSand = new List<string>();
    List<string> Aluminum = new List<string>();
    List<string> Ashphalt = new List<string>();
    List<string> Bitumen = new List<string>();
    List<string> Cement = new List<string>();
    List<string> Clay = new List<string>();
    List<string> Concrete = new List<string>();
    List<string> Glass = new List<string>();
    List<string> Steel = new List<string>();
    List<string> Timber = new List<string>();




    //testing calculation of material by volume
    double calculatedEC = 0;
    //double volume = buildingpart.GetVolume();
    for (int i = 0; i < subMaterial.Count; i++){
      if (materialDetail[i] == mtl)
      {
        calculatedEC = Convert.ToDouble(densityOfMaterial_kgPERm3[i]) * V * Convert.ToDouble(embodiedCarbon_kgPERkg[i]);
      }

    }

    // output
    EC = calculatedEC;
    EC_m2 = calculatedEC / V/2;
# ---------- end c_script_12 ----------
value_listener_3 = ValueListener(Elements=create_pulldown_menu_3, SomeProperty=True)  # -> Values, Indices
c_script_13 = CSharpScript(data=file, V=c_script_7.V, mtl=value_listener_3.Values)  # -> out, flatten(EC), EC_m2; inputs data: list of String, V: Double, mtl: String; same code as c_script_11
entwine_2 = Entwine(Branch0X=c_script_11.EC_m2, Branch1X=c_script_12.EC_m2, Branch2X=c_script_13.EC_m2, FlattenInputs=False)
bounds = Bounds(Numbers=flatten(entwine_2))
deconstruct_domain = DeconstructDomain(Domain=bounds)  # -> Start, End
list_item = ListItem(List=create_pulldown_menu, Index=0, Wrap=True)
gradient = Gradient(
    LowerLimit=deconstruct_domain.Start,
    UpperLimit=deconstruct_domain.End,
    Parameter=entwine_2,
    stops=[0: RGB(255, 255, 255), 1: RGB(255, 0, 0)])
list_item_2 = ListItem(List=create_pulldown_menu_2, Index=0, Wrap=True)
list_item_3 = ListItem(List=create_pulldown_menu_3, Index=0, Wrap=True)
create_expander = CreateExpander(UIElements=flatten(list_item), Header="Concrete", Open=True)
create_expander_2 = CreateExpander(UIElements=flatten(list_item_2), Header="Glass", Open=True)
create_expander_3 = CreateExpander(UIElements=flatten(list_item_3), Header="Wood", Open=True)
custom_preview = CustomPreview(Geometry=entwine, Material=gradient)

# ---- group: EC calc
merge = Merge(Data1=c_script_11.EC, Data2=c_script_12.EC, Data3=c_script_13.EC)
panel_10 = Panel("Wood")
panel_11 = Panel("Concrete")
panel_12 = Panel("Glass")
ma = MassAddition(Input=merge)  # -> flatten(Result), PartialResults
kg_co2e = Panel(merge)
merge_2 = Merge(Data1=panel_11, Data2=panel_12, Data3=panel_10)
division = Division(A=merge, B=ma.Result)
chart_type = ValueList({"Pie Chart": 0, "Horizontal Bar Chart": 1, "Vertical Bar Chart": 2, "Doughnut Chart": 3, "Gauge Chart": 4}, selected="Gauge Chart")
chart_type_2 = ValueList({"Pie Chart": 0, "Horizontal Bar Chart": 1, "Vertical Bar Chart": 2, "Doughnut Chart": 3, "Gauge Chart": 4}, selected="Vertical Bar Chart")
multiplication = Multiplication(A=division, B="100")
pan = Panel(merge_2)
percentage = Panel(multiplication)
chart = CreateChart(Data=percentage, Names=pan, Title="Embodied Carbon", SubTitle="Percentage", ChartType=chart_type)  # disabled
chart_2 = CreateChart(Data=kg_co2e, Names=pan, Title="Embodied Carbon", SubTitle="Total CO2e in kg", ChartType=chart_type_2)
create_separator = CreateSeparator(Thickness=0.5, Horizontal=True, Color=RGB(0, 0, 0))
merge_3 = Merge(Data1=chart, Data2=chart_2, Data3=create_separator)

# ----
merge_4 = Merge(Data1=create_expander, Data2=create_expander_2, Data3=create_expander_3, Data4=merge_3)
panel_13 = Panel("E:\Grad School\OneDrive - Harvard University\SCI6372\Comparison")
cluster = Cluster(folder_path=panel_13)
create_scroll_viewer = CreateScrollViewer(UIElements=cluster, HorizontalScrollBarVisibility=0, VerticalScrollBarVisibility=0)
tabbed_view = TabbedView(TabNames=["Materials & Calculations", "EC Data"], Tab0=flatten(merge_4), Tab1=flatten(create_scroll_viewer))
add_elements = AddElements(Window=launch_window, Elements=flatten(tabbed_view), DoVLChecking=True)  # -> AddedElements, ElementNames
set_tabbed_view = SetTabbedView(TabbedView=tabbed_view)
panel_14 = Panel(add_elements.ElementNames)
swatch = Red(SwatchColor=RGB(238, 73, 20))
swatch_2 = Red(SwatchColor=RGB(255, 136, 26))
swatch_3 = Red(SwatchColor=RGB(255, 187, 0))
swatch_4 = Red(SwatchColor=RGB(252, 217, 0))
swatch_5 = Red(SwatchColor=RGB(206, 220, 77))
merge_5 = Merge(Data1=swatch, Data2=swatch_2, Data3=swatch_3, Data4=swatch_4, Data5=swatch_5)
chartappearance = ChartAppearance(ChartToModify=[chart, chart_2], Colors=merge_5, Legend=Toggle(True), Title=Toggle(True))

# ==== cluster Cluster
folder_path = ClusterInput()
directory_contents = DirectoryContents(FolderPath=folder_path, Filter="*", IncludeSubfolders=False)  # -> FilePaths, FileNames
panel = Panel(directory_contents.FileNames)
list_item = ListItem(List=directory_contents.FilePaths, Index="21", Wrap=True)
list_item_2 = ListItem(List=directory_contents.FilePaths, Index="22", Wrap=True)
list_item_3 = ListItem(List=directory_contents.FilePaths, Index="6", Wrap=True)
list_item_4 = ListItem(List=directory_contents.FilePaths, Index="20", Wrap=True)
list_item_5 = ListItem(List=directory_contents.FilePaths, Index="12", Wrap=True)
list_item_6 = ListItem(List=directory_contents.FilePaths, Index="13", Wrap=True)
list_item_7 = ListItem(List=directory_contents.FilePaths, Index="19", Wrap=True)
list_item_8 = ListItem(List=directory_contents.FilePaths, Index="5", Wrap=True)
list_item_9 = ListItem(List=directory_contents.FilePaths, Index="7", Wrap=True)
list_item_10 = ListItem(List=directory_contents.FilePaths, Index="8", Wrap=True)
list_item_11 = ListItem(List=directory_contents.FilePaths, Index="11", Wrap=True)
list_item_12 = ListItem(List=directory_contents.FilePaths, Index="4", Wrap=True)
list_item_13 = ListItem(List=directory_contents.FilePaths, Index="10", Wrap=True)
list_item_14 = ListItem(List=directory_contents.FilePaths, Index="14", Wrap=True)
list_item_15 = ListItem(List=directory_contents.FilePaths, Index="15", Wrap=True)
list_item_16 = ListItem(List=directory_contents.FilePaths, Index="18", Wrap=True)
list_item_17 = ListItem(List=directory_contents.FilePaths, Index="9", Wrap=True)
list_item_18 = ListItem(List=directory_contents.FilePaths, Index="17", Wrap=True)
list_item_19 = ListItem(List=directory_contents.FilePaths, Index="1", Wrap=True)
list_item_20 = ListItem(List=directory_contents.FilePaths, Index="2", Wrap=True)
list_item_21 = ListItem(List=directory_contents.FilePaths, Index="3", Wrap=True)
list_item_22 = ListItem(List=directory_contents.FilePaths, Index="16", Wrap=True)
list_item_23 = ListItem(List=directory_contents.FilePaths, Index="0", Wrap=True)
create_image = CreateImage(ImageSource=list_item, ImageWidth="750")
create_image_2 = CreateImage(ImageSource=list_item_2, ImageWidth="750")
create_image_3 = CreateImage(ImageSource=list_item_3, ImageWidth="750")
create_image_4 = CreateImage(ImageSource=list_item_4, ImageWidth="750")
create_image_5 = CreateImage(ImageSource=list_item_5, ImageWidth="750")
create_image_6 = CreateImage(ImageSource=list_item_6, ImageWidth="750")
create_image_7 = CreateImage(ImageSource=list_item_7, ImageWidth="750")
create_image_8 = CreateImage(ImageSource=list_item_8, ImageWidth="750")
create_image_9 = CreateImage(ImageSource=list_item_9, ImageWidth="750")
create_image_10 = CreateImage(ImageSource=list_item_10, ImageWidth="750")
create_image_11 = CreateImage(ImageSource=list_item_11, ImageWidth="750")
create_image_12 = CreateImage(ImageSource=list_item_12, ImageWidth="750")
create_image_13 = CreateImage(ImageSource=list_item_13, ImageWidth="750")
create_image_14 = CreateImage(ImageSource=list_item_14, ImageWidth="750")
create_image_15 = CreateImage(ImageSource=list_item_15, ImageWidth="750")
create_image_16 = CreateImage(ImageSource=list_item_16, ImageWidth="750")
create_image_17 = CreateImage(ImageSource=list_item_17, ImageWidth="750")
create_image_18 = CreateImage(ImageSource=list_item_18, ImageWidth="750")
create_image_19 = CreateImage(ImageSource=list_item_19, ImageWidth="750")
create_image_20 = CreateImage(ImageSource=list_item_20, ImageWidth="750")
create_image_21 = CreateImage(ImageSource=list_item_21, ImageWidth="750")
create_image_22 = CreateImage(ImageSource=list_item_22, ImageWidth="750")
create_image_23 = CreateImage(ImageSource=list_item_23, ImageWidth="750")
create_expander = CreateExpander(UIElements=create_image_5, Header="With Average UK mix", Open=False)
create_expander_2 = CreateExpander(UIElements=create_image_6, Header="With By Cementitious Content - Ordinary Portland Cement ", Open=False)
create_expander_3 = CreateExpander(UIElements=create_image_7, Header="Block wall", Open=False)
create_expander_4 = CreateExpander(UIElements=create_image_9, Header="With CEM I Cement", Open=False)
create_expander_5 = CreateExpander(UIElements=create_image_10, Header="With PFA Cement", Open=False)
create_expander_6 = CreateExpander(UIElements=create_image_11, Header="With Natural Pozzolanic Ash Cement", Open=False)
create_expander_7 = CreateExpander(UIElements=create_image_20, Header="Asphalt: General", Open=False)
create_expander_8 = CreateExpander(UIElements=create_image_21, Header="Asphalt: Road", Open=False)
create_expander_9 = CreateExpander(UIElements=create_image_13, Header="With Limestone Cement", Open=False)
create_expander_10 = CreateExpander(UIElements=create_image_14, Header="With By Cementitious Content - PFA Cement Replacement ", Open=False)
create_expander_11 = CreateExpander(UIElements=create_image_15, Header="With By Cementitious Content - GGBS Cement Replacement ", Open=False)
create_expander_12 = CreateExpander(UIElements=create_image_16, Header="Pre-Cast", Open=False)
create_expander_13 = CreateExpander(UIElements=create_image_17, Header="With GGBS Cement", Open=False)
create_expander_14 = CreateExpander(UIElements=create_image_18, Header="With By Volumetric Proportions", Open=False)
create_expander_15 = CreateExpander(UIElements=create_image_22, Header="With By Cementitious Content - Average UK Replacement Rate", Open=False)
create_expander_16 = CreateExpander(
    UIElements=[create_expander_2, create_expander_15, create_expander_10, create_expander_11],
    Header="By Cementitious Content",
    Open=False)
merge = Merge(
    Data1=create_expander_4,
    Data2=create_expander_5,
    Data3=create_expander_13,
    Data4=create_expander_9,
    Data5=create_expander_6,
    Data6=create_expander,
    Data7=create_expander_16,
    Data8=create_expander_14,
    Data9=create_expander_12,
    Data10=create_expander_3)
create_expander_17 = CreateExpander(UIElements=create_image_2, Header="Timber", Open=False)
create_expander_18 = CreateExpander(UIElements=create_image, Header="Steel", Open=False)
create_expander_19 = CreateExpander(UIElements=create_image_4, Header="Glass", Open=False)
create_expander_20 = CreateExpander(UIElements=create_image_12, Header="Bituman", Open=False)
create_expander_21 = CreateExpander(UIElements=create_image_3, Header="Clay", Open=False)
create_expander_22 = CreateExpander(UIElements=merge, Header="Concrete", Open=False)
create_expander_23 = CreateExpander(UIElements=create_image_8, Header="Cement", Open=False)
create_expander_24 = CreateExpander(UIElements=[create_expander_7, create_expander_8], Header="Asphalt", Open=False)
create_expander_25 = CreateExpander(UIElements=create_image_23, Header="Aggregate", Open=False)
create_expander_26 = CreateExpander(UIElements=create_image_19, Header="Aluminum", Open=False)
merge_2 = Merge(
    Data1=create_expander_25,
    Data2=create_expander_26,
    Data3=create_expander_24,
    Data4=create_expander_20,
    Data5=create_expander_23,
    Data6=create_expander_21,
    Data7=create_expander_22,
    Data8=create_expander_19,
    Data9=create_expander_18,
    Data10=create_expander_17)
result = ClusterOutput(merge_2)
