# Grasshopper definition 12092020.gh (Grasshopper 1.0.7)
# plug-ins: Human UI, Spectacles.GrasshopperExporter, LunchBox, karambaGH

# EPD Data
# C:\Users\KRKH\OneDrive - Harvard University\Fall 2020\SCI 6372 Advanced  Topics on Embodied Carbon in Buildings\Final Project\Gh Scripts\From Jessica\OneDrive_1_11-25-2020\Testcsv1121.csv
panel = Panel("E:\Grad School\OneDrive - Harvard University\SCI6372\ICE DB V3.0\Testcsv1121.csv")
read_csv = ReadCSV(Delimiter=",")  # -> Headers, Values

file = ReadFile(File=panel, PerLineParse=True)
c_script = CSharpScript(data=file)  # -> out, Material, SubMaterial, MaterialDetail, UnitOfDeclaredUnit, WeightPerDeclaredUnit_kg, DensityOfMaterial_kgPERm3, EmbodiedCarbon_kgPERunit, EmbodiedCarbon_kgPERkg; inputs data: list of String
# ---------- c_script: C# usings ----------
using System.IO;
using System.Linq;
using System.Data;
using System.Drawing;
using System.Reflection;
using System.Windows.Forms;
using System.Xml;
using System.Xml.Linq;
using System.Runtime.InteropServices;

using Rhino.DocObjects;
using Rhino.Collections;
using GH_IO;
using GH_IO.Serialization;
# ---------- c_script: C# ----------
    //get material, submaterial, unit of declared unit, weight per declared unit, density, Embodied carbon, Embodied Carbon per kg
    //string is used split up the content in to indivisual lists at this point, since most of the columns contain both numbers and string
    //can convert the data to proper variable types during math operations later
    List<string> material = new List<string>();
    List<string> subMaterial = new List<string>();
    List<string> materialDetail = new List <string>();
    List<string> unitOfDeclaredUnit = new List<string>();
    List<string> weightPerDeclaredUnit_kg = new List<string>();
    List<string> densityOfMaterial_kgPERm3 = new List<string>();
    List<string> embodiedCarbon_kgPERunit = new List<string>();
    List<string> embodiedCarbon_kgPERkg = new List<string>();

    for (int i = 1; i < data.Count; i++) {
      //retrieve data
      string dataRow = data[i];

      // https://docs.microsoft.com/en-us/dotnet/api/system.string.split?view=netframework-4.5
      string[] dataColumns = dataRow.Split(',');

      //add content to list
      string mt = dataColumns[0];
      string smt = dataColumns[1];
      string md = dataColumns[2];
      string uodu = dataColumns[3];
      string wpdu_kg = dataColumns[4];
      string dom_kgPERm3 = dataColumns[5];
      string ec_kgPERunit = dataColumns[6];
      string ec_kgPERkg = dataColumns[7];

      material.Add(mt);
      subMaterial.Add(smt);
      materialDetail.Add(md);
      unitOfDeclaredUnit.Add(uodu);

      weightPerDeclaredUnit_kg.Add(wpdu_kg);
      densityOfMaterial_kgPERm3.Add(dom_kgPERm3);
      embodiedCarbon_kgPERunit.Add(ec_kgPERunit);
      embodiedCarbon_kgPERkg.Add(ec_kgPERkg);

    }

    // output
    Material = material;
    SubMaterial = subMaterial;
    UnitOfDeclaredUnit = unitOfDeclaredUnit;
    MaterialDetail = materialDetail;
    WeightPerDeclaredUnit_kg = weightPerDeclaredUnit_kg;
    DensityOfMaterial_kgPERm3 = densityOfMaterial_kgPERm3;
    EmbodiedCarbon_kgPERunit = embodiedCarbon_kgPERunit;
    EmbodiedCarbon_kgPERkg = embodiedCarbon_kgPERkg;
# ---------- end c_script ----------
material = Panel(c_script.Material)
# Data Reading/ Sorting
submaterial = Panel(c_script.SubMaterial)
materialdetail = Panel(c_script.MaterialDetail)
unit = Panel(c_script.UnitOfDeclaredUnit)
quantity = Panel(c_script.WeightPerDeclaredUnit_kg)
density = Panel(c_script.DensityOfMaterial_kgPERm3)
ec_kg_co2_unit = Panel(c_script.EmbodiedCarbon_kgPERunit)
ec_kg_co2_kg = Panel(c_script.EmbodiedCarbon_kgPERkg)

file_2 = ReadFile(File=panel, PerLineParse=True)

structure_column_cm = Slider(25, range=0..100)
slab_depth_m = Slider(0.25, range=0..2)
structure_beam_cm = Slider(47, range=0..100)

# ---- group: column spacing x
column_spacing_x = Slider(4, range=0..10)

# ---- group: column spacing y
column_spacing_y = Slider(6, range=0..10)

# ---- group: # of stories
n_of_storeys = Slider(3, range=1..10)

# ---- group: length (x)
# Parameter Input
length_x = Slider(4, range=0..500)

# ---- group: width (y)
width_y = Slider(12, range=0..500)

# ---- group: floor height
floor_height = Slider(3, range=0..10)

# ----
create_slider = CreateSlider(Slider=column_spacing_x, ShowBounds=False, ShowTicks=False, ShowTooltip=False, ShowValLabel=True, showLabel=True)
create_slider_2 = CreateSlider(Slider=column_spacing_y, ShowBounds=False, ShowTicks=False, ShowTooltip=False, ShowValLabel=True, showLabel=True)
create_slider_3 = CreateSlider(Slider=width_y, ShowBounds=False, ShowTicks=False, ShowTooltip=False, ShowValLabel=True, showLabel=True)
create_slider_4 = CreateSlider(Slider=floor_height, ShowBounds=False, ShowTicks=False, ShowTooltip=False, ShowValLabel=True, showLabel=True)
create_slider_5 = CreateSlider(Slider=length_x, ShowBounds=False, ShowTicks=False, ShowTooltip=False, ShowValLabel=True, showLabel=True)
create_slider_6 = CreateSlider(Slider=n_of_storeys, ShowBounds=False, ShowTicks=False, ShowTooltip=False, ShowValLabel=True, showLabel=True)
value_listener = ValueListener(Elements=create_slider_3, SomeProperty=True)  # -> Values, Indices
value_listener_2 = ValueListener(Elements=create_slider_5, SomeProperty=True)  # -> Values, Indices
value_listener_3 = ValueListener(Elements=create_slider_2, SomeProperty=True)  # -> Values, Indices
value_listener_4 = ValueListener(Elements=create_slider, SomeProperty=True)  # -> Values, Indices
value_listener_5 = ValueListener(Elements=create_slider_4, SomeProperty=True)  # -> Values, Indices
value_listener_6 = ValueListener(Elements=create_slider_6, SomeProperty=True)  # -> Values, Indices
set_slider = SetSlider(UISlider=create_slider_3, Value=value_listener.Values)
set_slider_2 = SetSlider(UISlider=create_slider_4, Value=value_listener_5.Values)
set_slider_3 = SetSlider(UISlider=create_slider_2, Value=value_listener_3.Values)
set_slider_4 = SetSlider(UISlider=create_slider, Value=value_listener_4.Values)
set_slider_5 = SetSlider(UISlider=create_slider_6, Value=value_listener_6.Values)
set_slider_6 = SetSlider(UISlider=create_slider_5, Value=value_listener_2.Values)

create_slider_7 = CreateSlider(Slider=structure_column_cm, ShowBounds=False, ShowTicks=False, ShowTooltip=False, ShowValLabel=True, showLabel=True)
create_slider_8 = CreateSlider(Slider=structure_beam_cm, ShowBounds=False, ShowTicks=False, ShowTooltip=False, ShowValLabel=True, showLabel=True)
create_slider_9 = CreateSlider(Slider=slab_depth_m, ShowBounds=False, ShowTicks=False, ShowTooltip=False, ShowValLabel=True, showLabel=True)
value_listener_7 = ValueListener(Elements=create_slider_8, SomeProperty=True)  # -> Values, Indices
value_listener_8 = ValueListener(Elements=create_slider_7, SomeProperty=True)  # -> Values, Indices
value_listener_9 = ValueListener(Elements=create_slider_9, SomeProperty=True)  # -> Values, Indices
set_slider_7 = SetSlider(UISlider=create_slider_9, Value=value_listener_9.Values)
merge = Merge(Data1=create_slider_7, Data2=create_slider_8, Data3=create_slider_9)
set_slider_8 = SetSlider(UISlider=create_slider_8, Value=value_listener_7.Values)
set_slider_9 = SetSlider(UISlider=create_slider_7, Value=value_listener_8.Values)

merge_2 = Merge(
    Data1=create_slider_5,
    Data2=create_slider_3,
    Data3=create_slider,
    Data4=create_slider_2,
    Data5=create_slider_4,
    Data6=create_slider_6)

# ---- group: initial set-up
plane_surface = PlaneSurface(Plane=PlaneXY(0, 0, 0), XSize=value_listener_2.Values, YSize=value_listener.Values)
unit_z = UnitZ(Factor="-1")
grid_structure = GridStructure(Surface=plane_surface, UDivisions=value_listener_4.Values, VDivisions=value_listener_3.Values)  # -> StructureLines, StructureNodes
# Initial Set-up
mesh_surface = MeshSurface(Surface=plane_surface, UCount=value_listener_4.Values, VCount=value_listener_3.Values, Overhang=True, Equalize=False)
line_sdl = LineSDL(Start=grid_structure.StructureNodes, Direction=unit_z, Length=value_listener_5.Values)

# ---- group: create multiple stories
unit_z_2 = UnitZ(Factor=value_listener_5.Values)
series = Series(Start=0, Step=value_listener_5.Values, Count=value_listener_6.Values)
unit_z_3 = UnitZ(Factor=value_listener_5.Values)
unit_z_4 = UnitZ(Factor=value_listener_5.Values)
series_2 = Series(Start=0, Step=value_listener_5.Values, Count=value_listener_6.Values)
series_3 = Series(Start=0, Step=value_listener_5.Values, Count=value_listener_6.Values)
move = Move(Geometry=mesh_surface, Motion=unit_z_2)  # -> Geometry, Transform
unit_z_5 = UnitZ(Factor=series)
move_2 = Move(Geometry=line_sdl, Motion=unit_z_3)  # -> Geometry, Transform
unit_z_6 = UnitZ(Factor=series_2)
unit_z_7 = UnitZ(Factor=series_3)
move_3 = Move(Geometry=grid_structure.StructureLines, Motion=unit_z_4)  # -> Geometry, Transform
move_4 = Move(Geometry=graft(move_2.Geometry), Motion=unit_z_6)  # -> Geometry, Transform
move_5 = Move(Geometry=graft(move.Geometry), Motion=unit_z_5)  # -> Geometry, Transform
move_6 = Move(Geometry=graft(move_3.Geometry), Motion=unit_z_7)  # -> Geometry, Transform

# ----
series_4 = Series(Start=0, Step=value_listener_5.Values, Count=value_listener_6.Values)
move_7 = Move(Geometry=plane_surface, Motion=unit_z_2)  # -> Geometry, Transform
unit_z_8 = UnitZ(Factor=series_4)
Z = UnitZ(Factor=value_listener_5.Values)
move_8 = Move(Geometry=graft(move_7.Geometry), Motion=unit_z_8)  # -> Geometry, Transform
neg = Negative(Value=Z)
extr = Extrude(Base=move_8.Geometry, Direction=neg)

# ----
# Blocking Context + Shading
number_slider = Slider(15, range=0..20)
srf = Surface(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)
Z_2 = UnitZ(Factor=number_slider)
X = UnitX(Factor=Slider(-26, range=-50..25))
X_2 = UnitX(Factor=Slider(14, range=-50..100))
Y = UnitY(Factor=Slider(12, range=-50..25))
extr_2 = Extrude(Base=srf, Direction=Z_2)
move_9 = Move(Geometry=extr_2, Motion=X)  # -> Geometry, Transform
move_10 = Move(Geometry=extr_2, Motion=X_2)  # -> Geometry, Transform
move_11 = Move(Geometry=extr_2, Motion=Y)  # -> Geometry, Transform
scale_nu = ScaleNU(
    Geometry=move_10.Geometry,
    Plane=srf,
    ScaleX=Slider(3.08, range=0..5),
    ScaleY=Slider(0.96, range=0..3),
    ScaleZ=Slider(1.04, range=0..3))  # -> Geometry, Transform
scale_nu_2 = ScaleNU(
    Geometry=move_9.Geometry,
    Plane=srf,
    ScaleX=Slider(2.88, range=0..5),
    ScaleY=Slider(0.84, range=0..3),
    ScaleZ=Slider(1.35, range=0..3))  # -> Geometry, Transform
# kg CO2e
scale_nu_3 = ScaleNU(
    Geometry=move_11.Geometry,
    Plane=srf,
    ScaleX=Slider(3.06, range=0..5),
    ScaleY=Slider(3, range=0..3),
    ScaleZ=Slider(1.25, range=0..3))  # -> Geometry, Transform
merge_3 = Merge(Data1=scale_nu_2.Geometry, Data2=scale_nu.Geometry, Data3=scale_nu_3.Geometry)
preview = CustomPreview(Geometry=merge_3, Material=ColourSwatch(SwatchColor=RGB(138, 138, 138)))
shading_device = Geometry(merge_3)

# ----
# Get Glass Surface
Y_2 = UnitY(Factor=value_listener.Values)
Y_3 = UnitY(Factor=value_listener.Values)
X_3 = UnitX(Factor=value_listener_2.Values)
X_4 = UnitX(Factor=value_listener_2.Values)
neg_2 = Negative(Value=Y_3)
neg_3 = Negative(Value=X_3)
move_12 = Move(Geometry=extr, Motion=Y_2)  # -> Geometry, Transform
move_13 = Move(Geometry=extr, Motion=X_4)  # -> Geometry, Transform
move_14 = Move(Geometry=extr, Motion=neg_2)  # -> Geometry, Transform
move_15 = Move(Geometry=extr, Motion=neg_3)  # -> Geometry, Transform
geo = Geometry(move_12.Geometry)
geo_2 = Geometry(move_15.Geometry)
geo_3 = Geometry(move_14.Geometry)
geo_4 = Geometry(move_13.Geometry)
debrep = DeconstructBrep(Brep=geo_2)  # -> Faces, Edges, Vertices
debrep_2 = DeconstructBrep(Brep=geo_4)  # -> Faces, Edges, Vertices
debrep_3 = DeconstructBrep(Brep=geo_3)  # -> Faces, Edges, Vertices
debrep_4 = DeconstructBrep(Brep=geo)  # -> Faces, Edges, Vertices
item = ListItem(List=debrep.Faces, Index=Slider(2, range=0..10), Wrap=True)
item_2 = ListItem(List=debrep_2.Faces, Index=Slider(4, range=0..10), Wrap=True)
item_3 = ListItem(List=debrep_3.Faces, Index=Slider(3, range=0..10), Wrap=True)
item_4 = ListItem(List=debrep_4.Faces, Index=Slider(1, range=0..10), Wrap=True)

# ----
# Shoebox
geo_5 = Geometry(extr)

# ---- group: load
unit_z_9 = UnitZ(Factor="-1.5")
loads_karamba3d = LoadsKaramba3D(Vector=unit_z_9, LCase=Slider(0, range=0..100), mode="Gravity")  # -> flatten(Load)

# ---- group: Chage Glazing Ratio, Orientation, and Program
number_slider_2 = Slider(0.9, range=0.1..0.9)
number_slider_3 = Slider(180, range=0..360)
hospital_programs = Slider(12, range=0..20)

# ----
bldgprograms = HBBuildingPrograms({"LargeOffice", "MediumOffice", "SmallOffice", "MidriseApartment", "HighriseApartment", "Retail", "StripMall", "PrimarySchool", "SecondarySchool", "SmallHotel", "LargeHotel", "Hospital", "Outpatient", "Laboratory", "Warehouse", "SuperMarket", "FullServiceRestaurant", "QuickServiceRestaurant", "Courthouse", "LargeDataCenterHighITE", "LargeDataCenterLowITE", "SmallDataCenterHighITE", "SmallDataCenterLowITE"}, selected="LargeOffice")
searchprog = HBSearchPrograms(bldg_prog=bldgprograms)  # -> room_prog; plug-in component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
panel_2 = Panel(searchprog)
item_5 = ListItem(List=searchprog, Index=hospital_programs, Wrap=True)
panel_3 = Panel(item_5)

# ---- group: run structural analysis
# Structure
panel_4 = Panel("Run Structural Analysis")
create_toggle = CreateToggle(Default=False, Label=panel_4)
value_listener_10 = ValueListener(Elements=create_toggle, SomeProperty=True)  # -> Values, Indices

# ----
create_toggle_2 = CreateToggle(Default=False, Label="Run Energy Analysis     ")
value_listener_11 = ValueListener(Elements=create_toggle_2, SomeProperty=True)  # -> Values, Indices

# ---- group: Material Selection
panel_5 = Panel("""AggregateSand
Aluminum
Asphalt
Bitumen
Cement
Clay
Concrete
Glass
Steel
Timber
Other""")
create_pulldown_menu = CreatePulldownMenu(Label="Wall Material", ListItems=panel_5, SelectedIndex="0", showLabel=True)
create_pulldown_menu_2 = CreatePulldownMenu(Label="Column Material", ListItems=panel_5, SelectedIndex="0", showLabel=True)
create_pulldown_menu_3 = CreatePulldownMenu(Label="Floor Plate Material", ListItems=panel_5, SelectedIndex="0", showLabel=True)
create_pulldown_menu_4 = CreatePulldownMenu(Label="Beam Material", ListItems=panel_5, SelectedIndex="0", showLabel=True)
value_listener_12 = ValueListener(Elements=create_pulldown_menu, SomeProperty=True)  # -> Values, Indices
value_listener_13 = ValueListener(Elements=create_pulldown_menu_2, SomeProperty=True)  # -> Values, Indices
value_listener_14 = ValueListener(Elements=create_pulldown_menu_3, SomeProperty=True)  # -> Values, Indices
value_listener_15 = ValueListener(Elements=create_pulldown_menu_4, SomeProperty=True)  # -> Values, Indices
c_script_2 = CSharpScript(data=file_2, mtl=value_listener_12.Values)  # -> out, sub_mtl; inputs data: list of String, mtl: String
# ---------- c_script_2: C# ----------
    //get material, submaterial, unit of declared unit, weight per declared unit, density, Embodied carbon, Embodied Carbon per kg
    //string is used split up the content in to indivisual lists at this point, since most of the columns contain both numbers and string
    //can convert the data to proper variable types during math operations later
    List<string> material = new List<string>();
    List<string> subMaterial = new List<string>();
    List<string> materialDetail = new List <string>();
    List<string> unitOfDeclaredUnit = new List<string>();
    List<string> weightPerDeclaredUnit_kg = new List<string>();
    List<string> densityOfMaterial_kgPERm3 = new List<string>();
    List<string> embodiedCarbon_kgPERunit = new List<string>();
    List<string> embodiedCarbon_kgPERkg = new List<string>();

    for (int i = 1; i < data.Count; i++) {
      //retrieve data
      string dataRow = data[i];

      // https://docs.microsoft.com/en-us/dotnet/api/system.string.split?view=netframework-4.5
      string[] dataColumns = dataRow.Split(',');

      //add content to list
      string mt = dataColumns[0];
      string smt = dataColumns[1];
      string md = dataColumns[2];
      string uodu = dataColumns[3];
      string wpdu_kg = dataColumns[4];
      string dom_kgPERm3 = dataColumns[5];
      string ec_kgPERunit = dataColumns[6];
      string ec_kgPERkg = dataColumns[7];

      material.Add(mt);
      subMaterial.Add(smt);
      materialDetail.Add(md);
      unitOfDeclaredUnit.Add(uodu);

      weightPerDeclaredUnit_kg.Add(wpdu_kg);
      densityOfMaterial_kgPERm3.Add(dom_kgPERm3);
      embodiedCarbon_kgPERunit.Add(ec_kgPERunit);
      embodiedCarbon_kgPERkg.Add(ec_kgPERkg);

    }

    // sorting
    List<string> material_name = new List<string>();
    List<string> _AggregateSand = new List<string>();
    List<string> _Aluminum = new List<string>();
    List<string> _Asphalt = new List<string>();
    List<string> _Bitumen = new List<string>();
    List<string> _Cement = new List<string>();
    List<string> _Clay = new List<string>();
    List<string> _Concrete = new List<string>();
    List<string> _Glass = new List<string>();
    List<string> _Steel = new List<string>();
    List<string> _Timber = new List<string>();

    for (int i = 0; i < materialDetail.Count - 4; i++)
    {
      if (materialDetail[i] != "-")
      {
        if (materialDetail[i].Substring(0, 3) == "Agg")
        {
          _AggregateSand.Add(materialDetail[i]);
        }
        else if (materialDetail[i].Substring(0, 3) == "Alu" || materialDetail[i].Substring(0, 3) == "alu")
        {
          _Aluminum.Add(materialDetail[i]);
        }
        else if (materialDetail[i].Substring(0, 3) == "Asp" || materialDetail[i].Substring(0, 3) == "asp")
        {
          _Asphalt.Add(materialDetail[i]);
        }
        else if (materialDetail[i].Substring(0, 3) == "Bit" || materialDetail[i].Substring(0, 3) == "bit")
        {
          _Bitumen.Add(materialDetail[i]);
        }
        else if (materialDetail[i].Substring(0, 3) == "Cem" || materialDetail[i].Substring(0, 3) == "cem")
        {
          _Cement.Add(materialDetail[i]);
        }
        else if (materialDetail[i].Substring(0, 3) == "Cla" || materialDetail[i].Substring(0, 3) == "cla")
        {
          _Clay.Add(materialDetail[i]);
        }
        else if (materialDetail[i].Substring(0, 3) == "Con" || materialDetail[i].Substring(0, 3) == "con")
        {
          _Concrete.Add(materialDetail[i]);
        }
        else if (materialDetail[i].Substring(0, 3) == "Gla" || materialDetail[i].Substring(0, 3) == "gla")
        {
          _Glass.Add(materialDetail[i]);
        }
        else if (materialDetail[i].Substring(0, 3) == "Ste" || materialDetail[i].Substring(0, 3) == "ste")
        {
          _Steel.Add(materialDetail[i]);
        }
        else if (materialDetail[i].Substring(0, 3) == "Tim" || materialDetail[i].Substring(0, 3) == "tim")
        {
          _Timber.Add(materialDetail[i]);
        }
      }

    }


    if (mtl == "AggregateSand")
    {
      sub_mtl = _AggregateSand;
    }
    else if (mtl == "Aluminum")
    {
      sub_mtl = _Aluminum;
    }
    else if (mtl == "Asphalt")
    {
      sub_mtl = _Asphalt;
    }
    else if (mtl == "Bitumen")
    {
      sub_mtl = _Bitumen;
    }
    else if (mtl == "Cement")
    {
      sub_mtl = _Cement;
    }
    else if (mtl == "Clay")
    {
      sub_mtl = _Clay;
    }
    else if (mtl == "Concrete")
    {
      sub_mtl = _Concrete;
    }
    else if (mtl == "Glass")
    {
      sub_mtl = _Glass;
    }
    else if (mtl == "Steel")
    {
      sub_mtl = _Steel;
    }
    else if (mtl == "Timber")
    {
      sub_mtl = _Timber;
    }
# ---------- end c_script_2 ----------
c_script_3 = CSharpScript(data=file_2, mtl="Glass")  # -> out, sub_mtl; inputs data: list of String, mtl: String; same code as c_script_2
c_script_4 = CSharpScript(data=file_2, mtl=value_listener_13.Values)  # -> out, sub_mtl; inputs data: list of String, mtl: String; same code as c_script_2
c_script_5 = CSharpScript(data=file_2, mtl=value_listener_14.Values)  # -> out, sub_mtl; inputs data: list of String, mtl: String; same code as c_script_2
c_script_6 = CSharpScript(data=file_2, mtl=value_listener_15.Values)  # -> out, sub_mtl; inputs data: list of String, mtl: String; same code as c_script_2
create_pulldown_menu_5 = CreatePulldownMenu(Label="Material Detail", ListItems=c_script_2.sub_mtl, SelectedIndex="0", showLabel=True)
# Material Selection
panel_6 = Panel("Material Detail")
create_text_box = CreateTextBox(Label="Wall Thickness (m)", DefaultText="0.3", UpdateButton=True, showLabel=True)
create_text_box_2 = CreateTextBox(Label="Window To Wall Ratio", DefaultText="0.75", UpdateButton=True, showLabel=True)
create_text_box_3 = CreateTextBox(Label="Glass Transmittance", DefaultText="0.55", UpdateButton=True, showLabel=True)
create_pulldown_menu_6 = CreatePulldownMenu(Label="Glass Material", ListItems=c_script_3.sub_mtl, SelectedIndex="0", showLabel=True)
create_pulldown_menu_7 = CreatePulldownMenu(Label="Material Detail", ListItems=c_script_4.sub_mtl, SelectedIndex="0", showLabel=True)
create_pulldown_menu_8 = CreatePulldownMenu(Label=panel_6, ListItems=c_script_5.sub_mtl, SelectedIndex="0", showLabel=True)
create_pulldown_menu_9 = CreatePulldownMenu(Label="Material Detail", ListItems=c_script_6.sub_mtl, SelectedIndex="0", showLabel=True)
value_listener_16 = ValueListener(Elements=create_pulldown_menu_5, SomeProperty=True)  # -> Values, Indices
value_listener_17 = ValueListener(Elements=create_text_box, SomeProperty=True)  # -> Values, Indices
value_listener_18 = ValueListener(Elements=create_text_box_2, SomeProperty=True)  # -> Values, Indices
value_listener_19 = ValueListener(Elements=create_text_box_3, SomeProperty=True)  # -> Values, Indices
value_listener_20 = ValueListener(Elements=create_pulldown_menu_6, SomeProperty=True)  # -> Values, Indices
value_listener_21 = ValueListener(Elements=create_pulldown_menu_7, SomeProperty=True)  # -> Values, Indices
value_listener_22 = ValueListener(Elements=create_pulldown_menu_8, SomeProperty=True)  # -> Values, Indices
value_listener_23 = ValueListener(Elements=create_pulldown_menu_9, SomeProperty=True)  # -> Values, Indices
set_textbox_contents = SetTextBoxContents(TextBoxToModify=create_text_box, NewTextBoxContents=value_listener_17.Values)
set_textbox_contents_2 = SetTextBoxContents(TextBoxToModify=create_text_box_3, NewTextBoxContents=value_listener_19.Values)
set_textbox_contents_3 = SetTextBoxContents(TextBoxToModify=create_text_box_2, NewTextBoxContents=value_listener_18.Values)
list_item = ListItem(List=[create_pulldown_menu, create_pulldown_menu_5], Index=0, Wrap=True)  # -> flatten(Item)
list_item_2 = ListItem(List=create_pulldown_menu_6, Index=0, Wrap=True)  # -> flatten(Item)
merge_4 = Merge(Data1=list_item, Data2=create_text_box)
list_item_3 = ListItem(List=[create_pulldown_menu_3, create_pulldown_menu_8], Index=0, Wrap=True)
list_item_4 = ListItem(List=[create_pulldown_menu_4, create_pulldown_menu_9], Index=0, Wrap=True)
list_item_5 = ListItem(List=[create_pulldown_menu_2, create_pulldown_menu_7], Index=0, Wrap=True)
merge_5 = Merge(Data1=list_item_2, Data2=create_text_box_2, Data3=create_text_box_3)
create_expander = CreateExpander(UIElements=merge_4, Header="Wall", Open=True)
create_expander_2 = CreateExpander(UIElements=flatten(list_item_3), Header="Floor Plate", Open=True)
create_expander_3 = CreateExpander(UIElements=flatten(merge_5), Header="Glass", Open=True)
create_expander_4 = CreateExpander(UIElements=flatten(list_item_4), Header="Beams", Open=True)
create_expander_5 = CreateExpander(UIElements=flatten(list_item_5), Header="Columns", Open=True)
merge_6 = Merge(
    Data1=create_expander_2,
    Data2=create_expander_4,
    Data3=create_expander_5,
    Data4=create_expander_3,
    Data5=create_expander,
    Data6=create_toggle_2)

# ----
# Materials for Shoebox
callfromepconstrlibrary = Honeybee_CallFromEPConstructionLibrary()  # -> ThermMaterials, EPMaterials, EPWindowMaterials, EPConstructions; plug-in component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
panel_7 = Panel(callfromepconstrlibrary.EPMaterials)
c_script_7 = CSharpScript(mtl=value_listener_21.Values, Reference="C:\Program Files\Rhino 6\Plug-ins\Karamba\karambaCommon.dll")  # -> out, Kmtl; inputs mtl: String
# ---------- c_script_7: C# ----------
    if (mtl.Substring(0, 3) == "Agg")
    {
      Print("invalid mtl");
    }
    else if (mtl.Substring(0, 3) == "Alu" || mtl.Substring(0, 3) == "alu")
    {
      Kmtl = "Metal Building";
    }
    else if (mtl.Substring(0, 3) == "Asp" || mtl.Substring(0, 3) == "asp")
    {
      Print("invalid mtl");
    }
    else if (mtl.Substring(0, 3) == "Bit" || mtl.Substring(0, 3) == "bit")
    {
      Print("invalid mtl");
    }
    else if (mtl.Substring(0, 3) == "Cem" || mtl.Substring(0, 3) == "cem")
    {
      Print("invalid mtl");
    }
    else if (mtl.Substring(0, 3) == "Cla" || mtl.Substring(0, 3) == "cla")
    {
      Kmtl = "Mass";
    }
    else if (mtl.Substring(0, 3) == "Con" || mtl.Substring(0, 3) == "con")
    {
      Kmtl = "Mass";
    }
    else if (mtl.Substring(0, 3) == "Gla" || mtl.Substring(0, 3) == "gla")
    {
      Print("invalid mtl");
    }
    else if (mtl.Substring(0, 3) == "Ste" || mtl.Substring(0, 3) == "ste")
    {
      Kmtl = "SteelFramed";
    }
    else if (mtl.Substring(0, 3) == "Tim" || mtl.Substring(0, 3) == "tim")
    {
      Kmtl = "WoodFramed";
    }
# ---------- end c_script_7 ----------
panel_8 = Panel(c_script_7.Kmtl)
setepzonecnstr = Honeybee_SetEPZoneConstruction()  # -> simplify(modifiedHBZones); plug-in component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
epconstruction = Honeybee_EnergyPlusConstruction(name="wall 01")  # -> EPConstruction; plug-in component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

bldg_vintage = Dragonfly_BldgAge({"ASHRAE 90.1 2013  |  IECC 2015": "2013", "ASHRAE 90.1 2010  |  IECC 2012": "2010", "ASHRAE 90.1 2007  |  IECC 2009": "2007", "ASHRAE 90.1 2004  |  IECC 2006": "2004", "1980-2004 (CBECS)": "1980_2004", "Pre-1980 (CBECS)": "pre_1980"}, selected="ASHRAE 90.1 2013  |  IECC 2015")
climate_zone = Dragonfly_BldgAge({"1 - Very Hot": "1", "2 - Hot": "2", "3 - Warm": "3", "4 - Mixed": "4", "5 - Cool": "5", "6 - Cold": "6", "7 - Very Cold": "7", "8 - Subarctic": "8"}, selected="4 - Mixed")
constr_type = Dragonfly_BldgAge({"SteelFramed", "WoodFramed", "Mass", "Metal Building"}, selected="Mass")
constrsetclimate = HBConstructionSetByClimate(climate_zone=climate_zone, vintage=bldg_vintage, constr_type=c_script_7.Kmtl)  # -> constr_set; plug-in component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

# ---- group: Context!
shade = HBShade(geo=shading_device)  # -> report, shades; plug-in component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

# ----
opaqueconstr = HBOpaqueConstruction(name="myLoggiaHouseWall", materials=["Generic 25mm Wood", "Typical Insulation-R30", "Generic 25mm Wood"])  # -> constr; plug-in component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
interiorsubset = HBInteriorConstructionSubset(interior_wall=opaqueconstr)  # -> interior_set; plug-in component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

panel_9 = Panel("https://www.energyplus.net/weather-download/north_and_central_america_wmo_region_4/USA/MA/USA_MA_Boston-Logan.Intl.AP.725090_TMY3/all")
downloadepw = LBDownloadWeather(weather_URL=panel_9)  # -> epw_file, stat_file, ddy_file; plug-in component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

panel_10 = Panel("https://www.energyplus.net/weather-download/north_and_central_america_wmo_region_4/USA/MA/USA_MA_Boston-Logan.Intl.AP.725090_TMY3/all")
downloadepw_2 = LBDownloadWeather(weather_URL=panel_10)  # -> epw_file, stat_file, ddy_file; plug-in component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
wea = HBWeaFromEPW(epw_file=downloadepw_2.epw_file)  # -> wea; plug-in component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

mcomp = Decompose(Mesh=move_5.Geometry)  # -> Vertices, Faces, Colours, Normals
c_script_8 = CSharpScript(x=mcomp.Vertices)  # -> out, First_Pt, Second_Pt, Third_Pt, Fourth_Pt; inputs x: list of Point3d
# ---------- c_script_8: C# ----------
    double xMin = 100000;
    double yMin = 100000;
    double xMax = 0;
    double yMax = 0;

    for (int i = 0; i < x.Count;i++)
    {
      if (x[i].X > xMax){
        xMax = x[i].X;}

      if (x[i].Y > yMax){
        yMax = x[i].Y;}

      if (x[i].X < xMin){
        xMin = x[i].X;}
      if (x[i].Y < yMin){
        yMin = x[i].Y;}
    }


    for (int i = 0; i < x.Count;i++)
    {
      if (x[i].X == xMin && x[i].Y == yMin){
        First_Pt = x[i];}
      if (x[i].X == xMax && x[i].Y == yMin){
        Second_Pt = x[i];}
      if (x[i].X == xMax && x[i].Y == yMax){
        Third_Pt = x[i];}
      if (x[i].X == xMin && x[i].Y == yMax){
        Fourth_Pt = x[i];}

    }
# ---------- end c_script_8 ----------
_4point_surface = _4PointSurface(CornerA=c_script_8.First_Pt, CornerB=c_script_8.Second_Pt, CornerC=c_script_8.Third_Pt, CornerD=c_script_8.Fourth_Pt)
# Embodied Carbon
Z_3 = UnitZ(Factor=value_listener_9.Values)
extr_3 = Extrude(Base=flatten(_4point_surface), Direction=Z_3)
c_script_9 = CSharpScript(data=file_2, buildingpart=extr_3, mtl=value_listener_22.Values)  # -> out, EC; inputs data: list of String, buildingpart: Brep, mtl: String
# ---------- c_script_9: C# ----------
    //get material, submaterial, unit of declared unit, weight per declared unit, density, Embodied carbon, Embodied Carbon per kg
    //string is used split up the content in to indivisual lists at this point, since most of the columns contain both numbers and string
    //can convert the data to proper variable types during math operations later
    List<string> material = new List<string>();
    List<string> subMaterial = new List<string>();
    List<string> materialDetail = new List <string>();
    List<string> unitOfDeclaredUnit = new List<string>();
    List<string> weightPerDeclaredUnit_kg = new List<string>();
    List<string> densityOfMaterial_kgPERm3 = new List<string>();
    List<string> embodiedCarbon_kgPERunit = new List<string>();
    List<string> embodiedCarbon_kgPERkg = new List<string>();

    for (int i = 1; i < data.Count; i++) {
      //retrieve data
      string dataRow = data[i];

      // https://docs.microsoft.com/en-us/dotnet/api/system.string.split?view=netframework-4.5
      string[] dataColumns = dataRow.Split(',');

      //add content to list
      string mt = dataColumns[0];
      string smt = dataColumns[1];
      string md = dataColumns[2];
      string uodu = dataColumns[3];
      string wpdu_kg = dataColumns[4];
      string dom_kgPERm3 = dataColumns[5];
      string ec_kgPERunit = dataColumns[6];
      string ec_kgPERkg = dataColumns[7];

      material.Add(mt);
      subMaterial.Add(smt);
      materialDetail.Add(md);
      unitOfDeclaredUnit.Add(uodu);

      weightPerDeclaredUnit_kg.Add(wpdu_kg);
      densityOfMaterial_kgPERm3.Add(dom_kgPERm3);
      embodiedCarbon_kgPERunit.Add(ec_kgPERunit);
      embodiedCarbon_kgPERkg.Add(ec_kgPERkg);

    }

    //testing calculation of material by volume
    double calculatedEC = 0;
    double volume = buildingpart.GetVolume();
    //double density = 0;
    for (int i = 0; i < materialDetail.Count; i++){
      if (materialDetail[i] == mtl)
      {
        calculatedEC = Convert.ToDouble(densityOfMaterial_kgPERm3[i]) * volume * Convert.ToDouble(embodiedCarbon_kgPERkg[i]);

      }

    }

    // output
    EC = calculatedEC;
# ---------- end c_script_9 ----------
ma = MassAddition(Input=c_script_9.EC)  # -> flatten(Result), PartialResults
multiplication = Multiplication(A=ma.Result, B="0.00110231")

# ----
# Embodied Carbon
# Slab
t_co2_e = Panel(multiplication)
kg_co2_e = Panel(ma.Result)

# ---- group: Input
create_toggle_3 = CreateToggle(Default=False, Label="Open Map")
create_text_box_4 = CreateTextBox(Label="Weather file download path ", UpdateButton=True, showLabel=True)
create_text_box_5 = CreateTextBox(Label="Building Lifespan (years)", DefaultText="30", UpdateButton=True, showLabel=True)
create_text_box_6 = CreateTextBox(Label="Local Electricity Carbon Intensity in kg of CO2e per kWh", DefaultText="0.45", UpdateButton=True, showLabel=True)
value_listener_24 = ValueListener(Elements=create_toggle_3, SomeProperty=True)  # -> Values, Indices
value_listener_25 = ValueListener(Elements=create_text_box_4, SomeProperty=True)  # -> Values, Indices
value_listener_26 = ValueListener(Elements=create_text_box_5, SomeProperty=True)  # -> Values, Indices
value_listener_27 = ValueListener(Elements=create_text_box_6, SomeProperty=True)  # -> flatten(Values), Indices
epwmap = LBEPWmap(epw_map=value_listener_24.Values)  # -> Output; plug-in component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
set_textbox_contents_4 = SetTextBoxContents(TextBoxToModify=create_text_box_4, NewTextBoxContents=value_listener_25.Values)
set_textbox_contents_5 = SetTextBoxContents(TextBoxToModify=create_text_box_5, NewTextBoxContents=value_listener_26.Values)
set_textbox_contents_6 = SetTextBoxContents(TextBoxToModify=create_text_box_6, NewTextBoxContents=value_listener_27.Values)
merge_7 = Merge(Data1=create_toggle_3, Data2=create_text_box_4, Data3=create_text_box_5, Data4=create_text_box_6)
create_expander_6 = CreateExpander(UIElements=merge_7, Header="Analysis Input", Open=True)

# ---- group: EC Data
panel_11 = Panel("E:\Grad School\OneDrive - Harvard University\SCI6372\Comparison")
cluster = Cluster(folder_path=panel_11)
create_label = CreateLabel(LabelText="Unit: kg of CO2e per kg", LabelSize="15", Justification=0)
merge_8 = Merge(Data1=create_label, Data2=cluster)
create_scroll_viewer = CreateScrollViewer(UIElements=merge_8, HorizontalScrollBarVisibility=0, VerticalScrollBarVisibility=0)

# ----
swatch = Red(SwatchColor=RGB(255, 255, 255))
create_toggle_4 = CreateToggle(Default=False, Label="Optimize                        ")
create_separator = CreateSeparator(Thickness="100", Horizontal=True, Color=swatch)

# ----
# Floor Plate
# Beam
# Column
c_script_10 = CSharpScript(mtl=value_listener_23.Values, Reference="C:\Program Files\Rhino 6\Plug-ins\Karamba\karambaCommon.dll")  # -> out, Kmtl; inputs mtl: String
# ---------- c_script_10: C# ----------
    if (mtl.Substring(0, 3) == "Agg")
    {
      Print("invalid mtl");
    }
    else if (mtl.Substring(0, 3) == "Alu" || mtl.Substring(0, 3) == "alu")
    {
      Print("invalid mtl");
    }
    else if (mtl.Substring(0, 3) == "Asp" || mtl.Substring(0, 3) == "asp")
    {
      Print("invalid mtl");
    }
    else if (mtl.Substring(0, 3) == "Bit" || mtl.Substring(0, 3) == "bit")
    {
      Print("invalid mtl");
    }
    else if (mtl.Substring(0, 3) == "Cem" || mtl.Substring(0, 3) == "cem")
    {
      Print("invalid mtl");
    }
    else if (mtl.Substring(0, 3) == "Cla" || mtl.Substring(0, 3) == "cla")
    {
      Print("invalid mtl");
    }
    else if (mtl.Substring(0, 3) == "Con" || mtl.Substring(0, 3) == "con")
    {
      Kmtl = "concrete";
    }
    else if (mtl.Substring(0, 3) == "Gla" || mtl.Substring(0, 3) == "gla")
    {
      Print("invalid mtl");
    }
    else if (mtl.Substring(0, 3) == "Ste" || mtl.Substring(0, 3) == "ste")
    {
      Kmtl = "steel";
    }
    else if (mtl.Substring(0, 3) == "Tim" || mtl.Substring(0, 3) == "tim")
    {
      Kmtl = "timber";
    }
# ---------- end c_script_10 ----------
c_script_11 = CSharpScript(mtl=value_listener_21.Values, Reference="C:\Program Files\Rhino 6\Plug-ins\Karamba\karambaCommon.dll")  # -> out, Kmtl; inputs mtl: String; same code as c_script_10
c_script_12 = CSharpScript(mtl=value_listener_23.Values, Reference="C:\Program Files\Rhino 6\Plug-ins\Karamba\karambaCommon.dll")  # -> out, Kmtl; inputs mtl: String; same code as c_script_10
material_selection_karamba3d = MaterialSelectionKaramba3D(NameOrListIndexOfMaterial=c_script_10.Kmtl, menu=[dropdown(0), dropdown(0)])
material_selection_karamba3d_2 = MaterialSelectionKaramba3D(NameOrListIndexOfMaterial=c_script_11.Kmtl, menu=[dropdown(0), dropdown(0)])
material_selection_karamba3d_3 = MaterialSelectionKaramba3D(NameOrListIndexOfMaterial=c_script_12.Kmtl, menu=[dropdown(0), dropdown(0)])
matselect = MaterialSelectionKaramba3D(Materials=material_selection_karamba3d_2, menu=[dropdown(0), dropdown(0)])
matselect_2 = MaterialSelectionKaramba3D(Materials=material_selection_karamba3d, menu=[dropdown(0), dropdown(0)])
matselect_3 = MaterialSelectionKaramba3D(Materials=material_selection_karamba3d_3, menu=[dropdown(1), dropdown(0)])
disassemble_material_karamba3d = DisassembleMaterialKaramba3D(Material=matselect_2)  # -> Material, TypeOfMaterial, FamilyNameOfMaterial, NameOfMaterial, ElemIdentifiers, Color, YoungsModulusKNCm2Dir12, InPlaneShearModulus_kN_cm2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
cross_section_karamba3d = CrossSectionKaramba3D(
    FamilyNameOfCrossSection="DefaultCroSec",
    ElementIdentifier="Columns",
    Material=matselect_2,
    Height_cm=value_listener_8.Values,
    UpperFlangeWidth_cm=value_listener_8.Values,
    LowerFlangeWidth_cm=value_listener_8.Values,
    UpperFlangeThickness_cm=0.4,
    LowerFlangeThickness_cm=0.4,
    SidewallsThickness_cm=0.4,
    FilletRadius_cm=0.6,
    mode="Box")
cross_section_karamba3d_2 = CrossSectionKaramba3D(
    FamilyNameOfCrossSection="DefaultCroSec",
    ElementIdentifier="Beams",
    Material=matselect_3,
    Height_cm=value_listener_7.Values,
    UpperFlangeWidth_cm=value_listener_7.Values,
    LowerFlangeWidth_cm=value_listener_7.Values,
    UpperFlangeThickness_cm=0.4,
    LowerFlangeThickness_cm=0.4,
    SidewallsThickness_cm=0.4,
    FilletRadius_cm=0.6,
    mode="Box")
cross_section_karamba3d_3 = CrossSectionKaramba3D(
    FamilyNameOfCrossSection="DefaultCroSec",
    ElementIdentifier="Slab",
    Materials=matselect,
    Heights_cm=value_listener_9.Values,
    mode="Shell - Var")
line = Line(flatten(move_6.Geometry))
mesh = Mesh(flatten(move_5.Geometry))
line_2 = Line(flatten(move_4.Geometry))
disassemble_cross_section_karamba3d = DisassembleCrossSectionKaramba3D(CroSec=cross_section_karamba3d)  # -> CrossSection, FamilyNameOfCrossSection, TypeNameOfCrossSection, ElemIdentifiers, Color, Material, LocalEccentricity_cm, Heights_cm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
disassemble_cross_section_karamba3d_2 = DisassembleCrossSectionKaramba3D(CroSec=cross_section_karamba3d_2)  # -> CrossSection, FamilyNameOfCrossSection, TypeNameOfCrossSection, ElemIdentifiers, Color, Material, LocalEccentricity_cm, Heights_cm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
negative = Negative(Value=disassemble_cross_section_karamba3d_2.PositionOfCenterOfGravity)
unit_z_10 = UnitZ(Factor=negative)
line_to_beam_karamba3d = LineToBeamKaramba3D(Line=line, Identifier="Beam", CrossSection=cross_section_karamba3d_2, New=True, Remove=True, LimitDistance_m=0.005)  # -> Element, Points, Info
mesh_to_shell_karamba3d = MeshToShellKaramba3D(Mesh=mesh, Identifier="Slab", CrossSection=cross_section_karamba3d_3, LimitDistance_m=0.005)  # -> Element, Points, Info
line_to_beam_karamba3d_2 = LineToBeamKaramba3D(Line=line_2, Identifier="Column", CrossSection=cross_section_karamba3d, New=True, Remove=True, LimitDistance_m=0.005)  # -> Element, Points, Info
eccentricity_on_cross_section_karamba3d = EccentricityOnCrossSectionKaramba3D(CrossSection=disassemble_cross_section_karamba3d_2.CrossSection, LocalEccentricity_cm=unit_z_10)
element_karamba3d = ElementKaramba3D(flatten([mesh_to_shell_karamba3d.Element, line_to_beam_karamba3d.Element, line_to_beam_karamba3d_2.Element]))
cross_section_karamba3d_4 = CrossSectionKaramba3D(flatten([cross_section_karamba3d_2, cross_section_karamba3d_3, eccentricity_on_cross_section_karamba3d, cross_section_karamba3d]))
stream_filter = StreamFilter(Gate=value_listener_10.Values, Stream1=cross_section_karamba3d_4)
stream_filter_2 = StreamFilter(Gate=value_listener_10.Values, Stream1=element_karamba3d)

# ---- group: support
end_points = EndPoints(Curve=line_2)  # -> Start, End
support_karamba3d = SupportKaramba3D(PosInd=end_points.End, menu=[buttons(on, on, on, on, on, on)])  # -> flatten(Support)

# ----
Y_4 = UnitY(Factor=1)
geo_6 = Geometry([<brep referenced from the Rhino model> x6])
line_3 = LineSDL(Start=end_points.End, Direction=Y_4, Length=Slider(25, range=0..100))
join = BrepJoin(Breps=geo_6)  # -> Breps, Closed
bcx = BrepCurve(Brep=join.Breps, Curve=line_3)  # -> Curves, Points
lng = ListLength(List=bcx.Points)
smaller = SmallerThan(FirstNumber=lng, SecondNumber=Slider(2, range=0..10))  # -> SmallerThan, OrEqualTo
Y_5 = UnitY(Factor=Slider(100, range=-50..100))
cull = CullPattern(List=end_points.End, CullPattern=smaller.SmallerThan)
loads = LoadsKaramba3D(ForceVector=Y_5, Local=False, PosInd=cull, LCase=Slider(1, range=0..1), mode="Point")

# ----
# Adding Live load as a constant - or perhaps
# as a graph. The larger the building, the
# higher the live load?
panel_12 = Panel([loads_karamba3d, loads])

c_script_13 = CSharpScript(x=flatten(move_6.Geometry), A=flatten(disassemble_cross_section_karamba3d_2.Area_cm2))  # -> out, V; inputs x: list of Line, A: list of Double
# ---------- c_script_13: C# ----------
    double massLength = 0;

    for(int i = 0; i < x.Count; i++){

      massLength = massLength + x[i].Length;
    }
    V = massLength * 0.0001 * A[0];
# ---------- end c_script_13 ----------
c_script_14 = CSharpScript(data=file_2, V=c_script_13.V, mtl=value_listener_23.Values)  # -> out, flatten(EC); inputs data: list of String, V: Double, mtl: String
# ---------- c_script_14: C# ----------
    //get material, submaterial, unit of declared unit, weight per declared unit, density, Embodied carbon, Embodied Carbon per kg
    //string is used split up the content in to indivisual lists at this point, since most of the columns contain both numbers and string
    //can convert the data to proper variable types during math operations later
    List<string> material = new List<string>();
    List<string> subMaterial = new List<string>();
    List<string> materialDetail = new List <string>();
    List<string> unitOfDeclaredUnit = new List<string>();
    List<string> weightPerDeclaredUnit_kg = new List<string>();
    List<string> densityOfMaterial_kgPERm3 = new List<string>();
    List<string> embodiedCarbon_kgPERunit = new List<string>();
    List<string> embodiedCarbon_kgPERkg = new List<string>();

    for (int i = 1; i < data.Count; i++) {
      //retrieve data
      string dataRow = data[i];

      // https://docs.microsoft.com/en-us/dotnet/api/system.string.split?view=netframework-4.5
      string[] dataColumns = dataRow.Split(',');

      //add content to list
      string mt = dataColumns[0];
      string smt = dataColumns[1];
      string md = dataColumns[2];
      string uodu = dataColumns[3];
      string wpdu_kg = dataColumns[4];
      string dom_kgPERm3 = dataColumns[5];
      string ec_kgPERunit = dataColumns[6];
      string ec_kgPERkg = dataColumns[7];

      material.Add(mt);
      subMaterial.Add(smt);
      materialDetail.Add(md);
      unitOfDeclaredUnit.Add(uodu);

      weightPerDeclaredUnit_kg.Add(wpdu_kg);
      densityOfMaterial_kgPERm3.Add(dom_kgPERm3);
      embodiedCarbon_kgPERunit.Add(ec_kgPERunit);
      embodiedCarbon_kgPERkg.Add(ec_kgPERkg);

    }

    // sorting
    List<string> material_name = new List<string>();
    List<string> AggregateSand = new List<string>();
    List<string> Aluminum = new List<string>();
    List<string> Ashphalt = new List<string>();
    List<string> Bitumen = new List<string>();
    List<string> Cement = new List<string>();
    List<string> Clay = new List<string>();
    List<string> Concrete = new List<string>();
    List<string> Glass = new List<string>();
    List<string> Steel = new List<string>();
    List<string> Timber = new List<string>();




    //testing calculation of material by volume
    double calculatedEC = 0;
    //double volume = buildingpart.GetVolume();
    for (int i = 0; i < subMaterial.Count; i++){
      if (materialDetail[i] == mtl)
      {
        calculatedEC = Convert.ToDouble(densityOfMaterial_kgPERm3[i]) * V * Convert.ToDouble(embodiedCarbon_kgPERkg[i]);
      }

    }

    // output
    EC = calculatedEC;
# ---------- end c_script_14 ----------
multiplication_2 = Multiplication(A=c_script_14.EC, B="0.00110231")

c_script_15 = CSharpScript(x=flatten(move_4.Geometry), A=flatten(disassemble_cross_section_karamba3d.Area_cm2))  # -> out, V; inputs x: list of Line, A: list of Double
# ---------- c_script_15: C# ----------
    double massLength = 0;
    for(int i = 0; i < x.Count; i++){
      massLength = massLength + x[i].Length;
    }
    V = massLength * 0.0001 * A[0];
# ---------- end c_script_15 ----------
c_script_16 = CSharpScript(data=file_2, V=c_script_15.V, mtl=value_listener_23.Values)  # -> out, flatten(EC); inputs data: list of String, V: Double, mtl: String; same code as c_script_14
multiplication_3 = Multiplication(A=c_script_16.EC, B="0.00110231")

# ----
# Embodied Carbon
# Beams
t_co2_e_2 = Panel(multiplication_2)
kg_co2_e_2 = Panel(c_script_14.EC)

# ----
# Embodied Carbon
# Columns
t_co2_e_3 = Panel(multiplication_3)
kg_co2_e_3 = Panel(c_script_16.EC)

# ----
# Energy Calculation
# DA Calculation
roomsolid = HBRoomFromSolid(geo=flatten(geo_5), constr_set=constrsetclimate, conditioned=True)  # -> report, rooms; plug-in component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
roomsolid_2 = HBRoomFromSolid(geo=flatten(geo_4), conditioned=True)  # -> report, rooms; plug-in component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
merge_9 = Merge(Data1=item_2, Data2=item, Data3=item_3, Data4=item_4)
panel_13 = Panel(roomsolid_2.rooms)
panel_14 = Panel(roomsolid.rooms)
ladybug = Ladybug_Ladybug()  # -> Vviiiiiiiiiizzz; plug-in component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
# Energy & Daylight
honeybee = Honeybee_Honeybee()  # -> Vviiiiiiiiiizzz; plug-in component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
solveadj = HBSolveAdjacency(rooms=flatten(roomsolid_2.rooms), run=value_listener_11.Values)  # -> report, adj_rooms; plug-in component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
solveadj_2 = HBSolveAdjacency(rooms=flatten(roomsolid.rooms), run=value_listener_11.Values)  # -> report, adj_rooms; plug-in component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
glassmod = HBGlassModifier(name="g_material", trans=value_listener_19.Values)  # -> modifier; plug-in component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
debrep_5 = DeconstructBrep(Brep=geo_5)  # -> Faces, Edges, Vertices
merge_10 = Merge(Data1=solveadj_2.adj_rooms, Data2=solveadj.adj_rooms)
Y_6 = UnitY(Factor=Slider(-100, range=-100..100))

srf_2 = Surface(merge_9)
area = Area(Geometry=srf_2)  # -> Area, Centroid
scale = Scale(Geometry=srf_2, Center=area.Centroid, Factor=value_listener_18.Values)  # -> flatten(Geometry), Transform
aperture = HBAperture(geo=scale.Geometry, operable=Toggle(True), rad_mod=glassmod)  # -> report, apertures; plug-in component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

mass_addition = MassAddition(Input=flatten(area.Area))  # -> Result, PartialResults
subtraction = Subtraction(A="1", GlassRatio=value_listener_18.Values)
multiplication_4 = Multiplication(WallRatio=subtraction, TotalFacadeArea=mass_addition.Result)
multiplication_5 = Multiplication(WallArea=multiplication_4, WallThickness=value_listener_17.Values)
c_script_17 = CSharpScript(data=file_2, V=multiplication_5, mtl=value_listener_16.Values)  # -> out, flatten(EC); inputs data: list of String, V: Double, mtl: String; same code as c_script_14

# ----
# Embodied Carbon
# Wall
kg_co2_e_4 = Panel(c_script_17.EC)

# ----
# Geometry for DA + Energy
area_2 = Area(Geometry=scale.Geometry)  # -> Area, Centroid
mass_addition_2 = MassAddition(Input=area_2.Area)  # -> Result, PartialResults
area_3 = Area(Geometry=plane_surface)  # -> Area, Centroid
multiplication_6 = Multiplication(A=area_3.Area, B=value_listener_6.Values)

c_script_18 = CSharpScript(data=file_2, area=mass_addition_2.Result, mtl=value_listener_20.Values)  # -> out, flatten(EC); inputs data: list of String, area: Double, mtl: String
# ---------- c_script_18: C# ----------
    //get material, submaterial, unit of declared unit, weight per declared unit, density, Embodied carbon, Embodied Carbon per kg
    //string is used split up the content in to indivisual lists at this point, since most of the columns contain both numbers and string
    //can convert the data to proper variable types during math operations later
    List<string> material = new List<string>();
    List<string> subMaterial = new List<string>();
    List<string> materialDetail = new List <string>();
    List<string> unitOfDeclaredUnit = new List<string>();
    List<string> weightPerDeclaredUnit_kg = new List<string>();
    List<string> densityOfMaterial_kgPERm3 = new List<string>();
    List<string> embodiedCarbon_kgPERunit = new List<string>();
    List<string> embodiedCarbon_kgPERkg = new List<string>();

    for (int i = 1; i < data.Count; i++) {
      //retrieve data
      string dataRow = data[i];

      // https://docs.microsoft.com/en-us/dotnet/api/system.string.split?view=netframework-4.5
      string[] dataColumns = dataRow.Split(',');

      //add content to list
      string mt = dataColumns[0];
      string smt = dataColumns[1];
      string md = dataColumns[2];
      string uodu = dataColumns[3];
      string wpdu_kg = dataColumns[4];
      string dom_kgPERm3 = dataColumns[5];
      string ec_kgPERunit = dataColumns[6];
      string ec_kgPERkg = dataColumns[7];

      material.Add(mt);
      subMaterial.Add(smt);
      materialDetail.Add(md);
      unitOfDeclaredUnit.Add(uodu);

      weightPerDeclaredUnit_kg.Add(wpdu_kg);
      densityOfMaterial_kgPERm3.Add(dom_kgPERm3);
      embodiedCarbon_kgPERunit.Add(ec_kgPERunit);
      embodiedCarbon_kgPERkg.Add(ec_kgPERkg);

    }

    //testing calculation of material by volume
    double calculatedEC = 0;

    for (int i = 0; i < materialDetail.Count; i++){
      if (materialDetail[i] == mtl)
      {
        calculatedEC = area * Convert.ToDouble(embodiedCarbon_kgPERunit[i]);
      }

    }

    // output
    EC = calculatedEC;
# ---------- end c_script_18 ----------

# ----
# Embodied Carbon
# Glass
kg_co2_e_5 = Panel(c_script_18.EC)

face = HBFace(geo=debrep_5.Faces, bc="Outdoors")  # -> report, faces; plug-in component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
room = HBRoom(faces=flatten(face.faces), name="Office Shoe Box", constr_set=constrsetclimate, program=item_5, conditioned=True)  # -> report, room; plug-in component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

load_karamba3d = LoadKaramba3D(flatten([loads_karamba3d, loads]))
stream_filter_3 = StreamFilter(Gate=value_listener_10.Values, Stream1=support_karamba3d)
stream_filter_4 = StreamFilter(Gate=value_listener_10.Values, Stream1=load_karamba3d)
assemble_model_karamba3d = AssembleModelKaramba3D(
    Elem=stream_filter_2,
    Support=stream_filter_3,
    Load=flatten(stream_filter_4),
    CrossSection=stream_filter,
    LimitDistance_m=0.005)  # -> Model, Info, Mass_kg, CenterOfGravity

# ---- group: model visualization
analyze_karamba3d = AnalyzeKaramba3D(Model=assemble_model_karamba3d.Model)  # -> CalculatedModel, MaximumDisplacement_cm, ResultingForceOfGravity_kN, ElasticEnergy_kNm
model_view_karamba3d = ModelViewKaramba3D(Model=analyze_karamba3d.CalculatedModel, ResultFactors=1, ResultCase=-1)  # -> Model, DeformedMesh, DeformedAxes, DeformedModel
beam_view_karamba3d = BeamViewKaramba3D(Model=model_view_karamba3d.Model)  # -> Model, MeshesOfRenderedBeams, DeformedBeamAxes, LegendColors, LegendTags

# ----
shellview = ShellViewKaramba3D(Model=model_view_karamba3d.Model, IndexOfLayer=0)  # -> Model, MeshesOfRenderedShells, LegendColors, LegendTags

addsubface = HBAddSubface(hb_obj=flatten(solveadj_2.adj_rooms), sub_faces=flatten(aperture.apertures))  # -> hb_obj; plug-in component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
solveadj_3 = HBSolveAdjacency(rooms=flatten(addsubface), ep_int_constr=interiorsubset, run=value_listener_11.Values)  # -> report, adj_rooms; plug-in component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
vizbytype = HBVisualizeByType(hb_objs=solveadj_3.adj_rooms)  # -> walls, interior_walls, roofs, ceilings, exterior_floors, interior_floors, air_walls, apertures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; plug-in component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
panel_15 = Panel(solveadj_3.adj_rooms)

rotate = HBRotate(hb_objs=flatten(addsubface), angle=number_slider_3)  # -> hb_objs; plug-in component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

model = HBModel(rooms=flatten(addsubface), shades=flatten(shade.shades), name="sample_model_grid")  # -> report, model; plug-in component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
gridrooms = HBSensorGridFromRooms(rooms=addsubface, grid_size="1", dist_floor=Slider(0.1, range=0..1))  # -> grid, points, mesh; plug-in component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
assigngridsviews = HBAssignGridsAndViews(model=model.model, grids=flatten(gridrooms.grid))  # -> model; plug-in component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
vizwiref = HBVizualizeWireframe(hb_objs=flatten(model.model))  # -> geo; plug-in component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

annualdaylight = HBAnnualDaylight(model=assigngridsviews, wea=wea, north=0, sensor_count="30", radiance_parameters=" ")  # -> recipe; plug-in component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
runrecipe = HBRunRecipe(recipe=annualdaylight, cpu_count=Slider(1, range=0..1), run=Toggle(False))  # -> report, results; plug-in component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

annualmetrics = HBAnnualDaylightMetrics(results=runrecipe.results, threshold="300")  # -> report, DA, UDI; plug-in component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

mjoin = MeshJoin(Meshes=gridrooms.mesh)
data = Data(flatten(annualmetrics.DA))
heatmap = LBSpatialHeatmap(values=data, mesh=mjoin, legend_title="%")  # -> mesh, legend, title, colors, legend_par; plug-in component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

annualloads = HBAnnualLoads(
    rooms=rotate,
    shades=shade.shades,
    epw_file=downloadepw.epw_file,
    run_bal=value_listener_11.Values,
    run=value_listener_11.Values)  # -> report, total_load, cooling, heating, lighting, equip, balance; plug-in component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
vizbytype_2 = HBVisualizeByType(hb_objs=rotate)  # -> walls, interior_walls, roofs, ceilings, exterior_floors, interior_floors, air_walls, apertures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; plug-in component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
panel_16 = Panel(annualloads.lighting)
data_2 = Data(flatten([annualloads.cooling, annualloads.heating, annualloads.lighting, annualloads.equip]))
gradient = Gradient(
    LowerLimit="91",
    UpperLimit="99",
    Parameter=annualmetrics.DA,
    stops=[0: RGB(234, 38, 0), 0.25: RGB(234, 126, 0), 0.5: RGB(254, 244, 84), 0.75: RGB(173, 203, 249), 1: RGB(75, 107, 169)])
legendpar = Ladybug_LegendParameters(lowBound="91", highBound="99", numSegments="5", customColors=flatten(gradient))  # -> legendPar; plug-in component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
recolormesh = Ladybug_RecolorMesh(analysisResult=data, inputMesh=heatmap.mesh, legendPar=legendpar)  # -> readMe, newMesh, newLegend, legendBasePt, meshColors, legendColors; plug-in component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
data_3 = Data(flatten(annualmetrics.DA))
avr = Average(Input=data_3)
move_16 = Move(Geometry=heatmap.mesh, Motion=Y_6)  # -> Geometry, Transform
panel_17 = Panel(avr)

ma_2 = MassAddition(Input=annualloads.total_load)  # -> Result, PartialResults
total_load_intensity_kwh_m2 = Panel(ma_2.Result)
panel_19 = Panel("""cooling
heating
lighting
equipment""")

monthly_loads = Data(annualloads.balance)
colrange = LBColorRange(index="19")  # -> colors; plug-in component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
neg_4 = Negative(Value="70")
legendpar_2 = LBLegendParameters(min=neg_4, max="70", colors=colrange, num_decimals="0")  # -> leg_par; plug-in component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
monthlychart = LBMonthlyChart(data=monthly_loads, base_pt="40,-60,0", stack=Toggle(True), legend_par=legendpar_2)  # -> report, data_mesh, data_lines, legend, borders, labels, y_title, title; plug-in component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
medges = MeshEdges(Mesh=monthlychart.data_mesh)  # -> NakedEdges, InteriorEdges, NonManifoldEdges

monthly_loads_2 = Data(data_2)
legendpar_3 = LBLegendParameters(
    max="35",
    colors=[ColourSwatch(SwatchColor=RGB(0, 136, 255)), ColourSwatch(SwatchColor=RGB(255, 0, 0)), ColourSwatch(SwatchColor=RGB(255, 255, 0)), ColourSwatch(SwatchColor=RGB(255, 174, 0))],
    num_decimals="0")  # -> leg_par; plug-in component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
monthlychart_2 = LBMonthlyChart(data=monthly_loads_2, base_pt="40,0,0", stack=Toggle(True), legend_par=legendpar_3)  # -> report, data_mesh, data_lines, legend, borders, labels, y_title, title; plug-in component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
medges_2 = MeshEdges(Mesh=monthlychart_2.data_mesh)  # -> NakedEdges, InteriorEdges, NonManifoldEdges

stream_filter_5 = StreamFilter(Gate=value_listener_11.Values, Stream0="0", Stream1=ma_2.Result)
multiplication_7 = Multiplication(A=stream_filter_5, B=multiplication_6)  # -> flatten(TotalKWhYr)
multiplication_8 = Multiplication(A=value_listener_27.Values, B=multiplication_7)

multiplication_9 = Multiplication(A=value_listener_5.Values, B=value_listener_6.Values)
srf_3 = Surface(plane_surface)
mesh_2 = Mesh([beam_view_karamba3d.MeshesOfRenderedBeams, shellview.MeshesOfRenderedShells])
meshcorners = MeshCorners(M=beam_view_karamba3d.MeshesOfRenderedBeams, A=0.5235987756)
Z_4 = UnitZ(Factor=multiplication_9)
mesh_explode = MeshExplode(m=mesh_2)  # -> out, simplify(A)
# ---------- mesh_explode: VB ----------
    Component.Params.Input(0).Name = "Mesh"
    Component.Params.Input(0).Description = "Open or closed mesh"

    Component.Params.Output(1).Name = "Mesh"
    Component.Params.Output(1).Description = "If successful, a valid mesh"

    If m IsNot Nothing Then
      Dim pts As Rhino.Geometry.Collections.MeshVertexList
      Dim faces As Rhino.Geometry.Collections.MeshFaceList
      Dim clrs As Rhino.Geometry.Collections.MeshVertexColorList
      Dim i As Integer
      Dim mshs As New list(Of mesh)

      faces = m.Faces
      pts = m.Vertices
      If m.VertexColors.count() = 0 Then m.VertexColors.CreateMonotoneMesh(color.FromArgb(100, 100, 100))
      clrs = m.VertexColors

      For i = 0 To faces.count() - 1 Step 1
        Dim fc As New meshFace
        Dim face As New MeshFace
        Dim ptList As New list(Of point3d)
        Dim clrList As New list(Of color)
        Dim msh As New mesh

        face = faces(i)

        ptList.add(New point3d(pts(face.A)))
        ptList.add(New point3d(pts(face.B)))
        ptList.add(New point3d(pts(face.C)))
        If face.IsQuad Then ptList.add(New point3d(pts(face.D)))

        clrList.add(clrs(face.A))
        clrList.add(clrs(face.B))
        clrList.add(clrs(face.C))
        If face.IsQuad Then clrList.add(clrs(face.D))

        If face.IsQuad Then fc = New meshFace(0, 1, 2, 3) Else fc = New meshface(0, 1, 2)

        msh.Vertices.AddVertices(ptList.toarray())
        msh.Faces.AddFace(fc)
        msh.VertexColors.SetColors(clrList.toarray())
        mshs.add(msh)
      Next

      A = mshs
    End If
# ---------- end mesh_explode ----------
extr_4 = Extrude(Base=srf_3, Direction=Z_4)
meshit = MeshItMANI11(mesh_brep=flatten(extr_4))
geo_7 = Geometry(vizbytype.apertures)
preview_2 = CustomPreview(
    Geometry=mesh_explode.A,
    Material={diffuse=RGB(221, 160, 221), emission=RGB(66, 48, 66), shine=0.5, specular=RGB(255, 255, 255), transparency=0})
preview_3 = CustomPreview(Geometry=extr_4, Material=ColourSwatch(SwatchColor=RGBA(255, 255, 255, 107)))
ln = Line(StartPoint=meshcorners, EndPoint=meshcorners)
spectacles_meshcoloredvertices = Spectacles_MeshColoredVertices(Mesh=move_16.Geometry)

# ----
# Model
swatch_2 = ColourSwatch(SwatchColor=RGB(255, 0, 0))
mcol = MeshColours(Mesh=[beam_view_karamba3d.MeshesOfRenderedBeams, meshit], Colours=swatch_2)
spectacles_line = Spectacles_Line(Line=ln)
spectacles_meshcoloredvertices_2 = Spectacles_MeshColoredVertices(Mesh=mcol)
sceneobjects = Spectacles_SceneObjects(Elements=flatten([spectacles_meshcoloredvertices_2, spectacles_line]))

# ---- group: EC calc
merge_11 = Merge(Data1=kg_co2_e, Data2=kg_co2_e_2, Data3=kg_co2_e_3, Data4=kg_co2_e_5, Data5=kg_co2_e_4)
ma_3 = MassAddition(Input=merge_11)  # -> flatten(Result), PartialResults
kg_co2e = Panel(merge_11)
chart_type = ValueList({"Pie Chart": 0, "Horizontal Bar Chart": 1, "Vertical Bar Chart": 2, "Doughnut Chart": 3, "Gauge Chart": 4}, selected="Gauge Chart")
division = Division(A=merge_11, B=ma_3.Result)
chart_type_2 = ValueList({"Pie Chart": 0, "Horizontal Bar Chart": 1, "Vertical Bar Chart": 2, "Doughnut Chart": 3, "Gauge Chart": 4}, selected="Vertical Bar Chart")
multiplication_10 = Multiplication(A=division, B="100")
percentage = Panel(multiplication_10)
create_separator_2 = CreateSeparator(Thickness=0.5, Horizontal=True, Color=RGB(0, 0, 0))

# ----
swatch_3 = Red(SwatchColor=RGB(238, 73, 20))
swatch_4 = Red(SwatchColor=RGB(255, 136, 26))
swatch_5 = Red(SwatchColor=RGB(255, 187, 0))
swatch_6 = Red(SwatchColor=RGB(252, 217, 0))
swatch_7 = Red(SwatchColor=RGB(206, 220, 77))
swatch_8 = Red(SwatchColor=RGB(255, 255, 255))
swatch_9 = Red(SwatchColor=RGB(255, 255, 255))
merge_12 = Merge(Data1=swatch_3, Data2=swatch_4, Data3=swatch_5, Data4=swatch_6, Data5=swatch_7)
create_separator_3 = CreateSeparator(Thickness="100", Horizontal=True, Color=swatch_8)
create_separator_4 = CreateSeparator(Thickness="20", Horizontal=True, Color=swatch_9)
multiplication_11 = Multiplication(A=value_listener_26.Values, B=multiplication_8)
create_label_2 = CreateLabel(LabelText="Size of Structural Members", LabelSize="15", Justification=0)
create_label_3 = CreateLabel(LabelText="Basic Parameters", LabelSize="15", Justification=0)
merge_13 = Merge(
    Data2=create_label_3,
    Data3=merge_2,
    Data4=create_separator_4,
    Data5=create_label_2,
    Data6=merge,
    Data7=create_separator_3,
    Data9=create_expander_6)
merge_14 = Merge(Data1=create_toggle, Data2=create_separator, Data3=create_toggle_4)
cluster_2 = Cluster_2()
value_list = ValueList({"Red"}, selected="Red")
swatch_10 = Red(SwatchColor=RGB(255, 30, 0))

# ---- group: EC calc (continued)
merge_15 = Merge(Data1="slab", Data2="beams", Data3="columns", Data4="glass", Data5="wall")
pan = Panel(merge_15)
chart = CreateChart(Data=percentage, Names=pan, Title="Embodied Carbon", SubTitle="Percentage", ChartType=chart_type)
chart_2 = CreateChart(Data=kg_co2e, Names=pan, Title="Embodied Carbon", SubTitle="Total CO2e in kg", ChartType=chart_type_2)
merge_16 = Merge(Data1=chart, Data2=chart_2, Data3=create_separator_2)

# ----
cost_of_electricity_kwh = Panel(value_listener_27.Values)
key = Panel("""Ligting
Equipment
Cooling
Heating
Fans
Pmps""")

multiplication_12 = Multiplication(A=annualloads.total_load, B=cost_of_electricity_kwh)

# ----
# Annual Utility Cost
data_4 = Data(multiplication_12)
ma_4 = MassAddition(Input=data_4)  # -> flatten(Result), PartialResults
annual_utility_cost_m2 = Panel(ma_4.Result)
ma_5 = MassAddition(Input=annual_utility_cost_m2)  # -> Result, PartialResults
annual_utility_cost_m2_2 = Panel(ma_5.Result)

# ---- group: Utility
create_label_4 = CreateLabel(LabelText="Annual Utility Cost ($/m2)", LabelSize=12, Justification=0)
create_label_5 = CreateLabel(LabelText=annual_utility_cost_m2, LabelSize=12, Justification=0)
merge_17 = Merge(Data1=create_label_4, Data2=create_label_5)
create_expander_7 = CreateExpander(UIElements=merge_17, Header="Utility Cost", Open=True)

# ---- group: OC calc
create_label_6 = CreateLabel(LabelText=multiplication_11, LabelSize=12, Justification=0)
create_label_7 = CreateLabel(LabelText="Total Operational Carbon (Electricity) in kg", LabelSize=12, Justification=0)
mass_addition_3 = MassAddition(Input=kg_co2e)  # -> flatten(Result), PartialResults
chart_type_3 = ValueList({"Pie Chart": 0, "Horizontal Bar Chart": 1, "Vertical Bar Chart": 2, "Doughnut Chart": 3, "Gauge Chart": 4}, selected="Pie Chart")
merge_18 = Merge(Data1=mass_addition_3.Result, Data2=multiplication_11)
chart_type_4 = ValueList({"Pie Chart": 0, "Horizontal Bar Chart": 1, "Vertical Bar Chart": 2, "Doughnut Chart": 3, "Gauge Chart": 4}, selected="Vertical Bar Chart")
ma_6 = MassAddition(Input=merge_18)  # -> flatten(Result), PartialResults
division_2 = Division(A=merge_18, B=ma_6.Result)
multiplication_13 = Multiplication(A=division_2, B="100")
pan_2 = Panel("""Embodied Carbon
Operational Carbon""")
pan_3 = Panel("""Embodied Carbon
Operational Carbon""")
chart_3 = CreateChart(Data=multiplication_13, Names=pan_2, Title="Total Carbon", SubTitle="Percentage", ChartType=chart_type_3)
chart_4 = CreateChart(Data=merge_18, Names=pan_3, SubTitle="kg CO2e", ChartType=chart_type_4)

# ----
# UI
chartappearance = ChartAppearance(ChartToModify=[chart, chart_2, chart_3, chart_4], Colors=merge_12, Legend=Toggle(True), Title=Toggle(True))
merge_19 = Merge(Data1=create_label_7, Data2=create_label_6)

# ---- group: OC calc (continued)
create_expander_8 = CreateExpander(UIElements=flatten(merge_19), Header="Calculated Operational Carbon", Open=True)
merge_20 = Merge(Data2=create_expander_8, Data3=create_expander_7, Data4=chart_3, Data5=chart_4)

# ---- group: Main UI Window
panel_20 = Panel("Input")
number_slider_4 = Slider(800, range=0..1000)
panel_21 = Panel("EC Data")
panel_22 = Panel("Materials")
launch_window = LaunchWindow(
    Show=Toggle(True),
    Name="Cardinal Calculator",
    Width=number_slider_4,
    Height=Slider(1000, range=0..1000),
    ChildStatus=0,
    EnableHorizScroll=False)
panel_23 = Panel("EC Calc.")

# ----
division_3 = Division(A=number_slider_4, B="30")
merge_21 = Merge(Data1="Home", Data2=panel_20, Data3=panel_21, Data4=panel_22, Data5=panel_23, Data6="OC Calc.", Data7="Struc.& Opt.")
set_window_properties = SetWindowProperties(Window=launch_window, AccentColor=value_list, ShowTitleBar=True, ScaleFactor=1)

# ---- group: Main UI Window (continued)
tabbed_view = TabbedView(
    TabNames=merge_21,
    TabTextSize=division_3,
    Tab0=flatten(cluster_2),
    Tab1=flatten(merge_13),
    Tab2=flatten(create_scroll_viewer),
    Tab3=flatten(merge_6),
    Tab4=flatten(merge_16),
    Tab5=flatten(merge_20),
    Tab6=flatten(merge_14))
add_elements = AddElements(Window=launch_window, Elements=flatten(tabbed_view), DoVLChecking=True)  # -> AddedElements, ElementNames
set_tabbed_view = SetTabbedView(TabbedView=tabbed_view)

# ==== cluster Cluster
folder_path = ClusterInput()
directory_contents = DirectoryContents(FolderPath=folder_path, Filter="*", IncludeSubfolders=False)  # -> FilePaths, FileNames
panel = Panel(directory_contents.FileNames)
list_item = ListItem(List=directory_contents.FilePaths, Index="21", Wrap=True)
list_item_2 = ListItem(List=directory_contents.FilePaths, Index="22", Wrap=True)
list_item_3 = ListItem(List=directory_contents.FilePaths, Index="6", Wrap=True)
list_item_4 = ListItem(List=directory_contents.FilePaths, Index="20", Wrap=True)
list_item_5 = ListItem(List=directory_contents.FilePaths, Index="12", Wrap=True)
list_item_6 = ListItem(List=directory_contents.FilePaths, Index="13", Wrap=True)
list_item_7 = ListItem(List=directory_contents.FilePaths, Index="19", Wrap=True)
list_item_8 = ListItem(List=directory_contents.FilePaths, Index="5", Wrap=True)
list_item_9 = ListItem(List=directory_contents.FilePaths, Index="7", Wrap=True)
list_item_10 = ListItem(List=directory_contents.FilePaths, Index="8", Wrap=True)
list_item_11 = ListItem(List=directory_contents.FilePaths, Index="11", Wrap=True)
list_item_12 = ListItem(List=directory_contents.FilePaths, Index="4", Wrap=True)
list_item_13 = ListItem(List=directory_contents.FilePaths, Index="10", Wrap=True)
list_item_14 = ListItem(List=directory_contents.FilePaths, Index="14", Wrap=True)
list_item_15 = ListItem(List=directory_contents.FilePaths, Index="15", Wrap=True)
list_item_16 = ListItem(List=directory_contents.FilePaths, Index="18", Wrap=True)
list_item_17 = ListItem(List=directory_contents.FilePaths, Index="9", Wrap=True)
list_item_18 = ListItem(List=directory_contents.FilePaths, Index="17", Wrap=True)
list_item_19 = ListItem(List=directory_contents.FilePaths, Index="1", Wrap=True)
list_item_20 = ListItem(List=directory_contents.FilePaths, Index="2", Wrap=True)
list_item_21 = ListItem(List=directory_contents.FilePaths, Index="3", Wrap=True)
list_item_22 = ListItem(List=directory_contents.FilePaths, Index="16", Wrap=True)
list_item_23 = ListItem(List=directory_contents.FilePaths, Index="0", Wrap=True)
create_image = CreateImage(ImageSource=list_item, ImageWidth="600")
create_image_2 = CreateImage(ImageSource=list_item_2, ImageWidth="600")
create_image_3 = CreateImage(ImageSource=list_item_3, ImageWidth="600")
create_image_4 = CreateImage(ImageSource=list_item_4, ImageWidth="600")
create_image_5 = CreateImage(ImageSource=list_item_5, ImageWidth="600")
create_image_6 = CreateImage(ImageSource=list_item_6, ImageWidth="600")
create_image_7 = CreateImage(ImageSource=list_item_7, ImageWidth="600")
create_image_8 = CreateImage(ImageSource=list_item_8, ImageWidth="600")
create_image_9 = CreateImage(ImageSource=list_item_9, ImageWidth="600")
create_image_10 = CreateImage(ImageSource=list_item_10, ImageWidth="600")
create_image_11 = CreateImage(ImageSource=list_item_11, ImageWidth="600")
create_image_12 = CreateImage(ImageSource=list_item_12, ImageWidth="600")
create_image_13 = CreateImage(ImageSource=list_item_13, ImageWidth="600")
create_image_14 = CreateImage(ImageSource=list_item_14, ImageWidth="600")
create_image_15 = CreateImage(ImageSource=list_item_15, ImageWidth="600")
create_image_16 = CreateImage(ImageSource=list_item_16, ImageWidth="600")
create_image_17 = CreateImage(ImageSource=list_item_17, ImageWidth="600")
create_image_18 = CreateImage(ImageSource=list_item_18, ImageWidth="600")
create_image_19 = CreateImage(ImageSource=list_item_19, ImageWidth="600")
create_image_20 = CreateImage(ImageSource=list_item_20, ImageWidth="600")
create_image_21 = CreateImage(ImageSource=list_item_21, ImageWidth="600")
create_image_22 = CreateImage(ImageSource=list_item_22, ImageWidth="600")
create_image_23 = CreateImage(ImageSource=list_item_23, ImageWidth="600")
create_expander = CreateExpander(UIElements=create_image_5, Header="With Average UK mix", Open=False)
create_expander_2 = CreateExpander(UIElements=create_image_6, Header="With By Cementitious Content - Ordinary Portland Cement ", Open=False)
create_expander_3 = CreateExpander(UIElements=create_image_7, Header="Block wall", Open=False)
create_expander_4 = CreateExpander(UIElements=create_image_9, Header="With CEM I Cement", Open=False)
create_expander_5 = CreateExpander(UIElements=create_image_10, Header="With PFA Cement", Open=False)
create_expander_6 = CreateExpander(UIElements=create_image_11, Header="With Natural Pozzolanic Ash Cement", Open=False)
create_expander_7 = CreateExpander(UIElements=create_image_20, Header="Asphalt: General", Open=False)
create_expander_8 = CreateExpander(UIElements=create_image_21, Header="Asphalt: Road", Open=False)
create_expander_9 = CreateExpander(UIElements=create_image_13, Header="With Limestone Cement", Open=False)
create_expander_10 = CreateExpander(UIElements=create_image_14, Header="With By Cementitious Content - PFA Cement Replacement ", Open=False)
create_expander_11 = CreateExpander(UIElements=create_image_15, Header="With By Cementitious Content - GGBS Cement Replacement ", Open=False)
create_expander_12 = CreateExpander(UIElements=create_image_16, Header="Pre-Cast", Open=False)
create_expander_13 = CreateExpander(UIElements=create_image_17, Header="With GGBS Cement", Open=False)
create_expander_14 = CreateExpander(UIElements=create_image_18, Header="With By Volumetric Proportions", Open=False)
create_expander_15 = CreateExpander(UIElements=create_image_22, Header="With By Cementitious Content - Average UK Replacement Rate", Open=False)
create_expander_16 = CreateExpander(
    UIElements=[create_expander_2, create_expander_15, create_expander_10, create_expander_11],
    Header="By Cementitious Content",
    Open=False)
merge = Merge(
    Data1=create_expander_4,
    Data2=create_expander_5,
    Data3=create_expander_13,
    Data4=create_expander_9,
    Data5=create_expander_6,
    Data6=create_expander,
    Data7=create_expander_16,
    Data8=create_expander_14,
    Data9=create_expander_12,
    Data10=create_expander_3)
create_expander_17 = CreateExpander(UIElements=create_image_2, Header="Timber", Open=False)
create_expander_18 = CreateExpander(UIElements=create_image, Header="Steel", Open=False)
create_expander_19 = CreateExpander(UIElements=create_image_4, Header="Glass", Open=False)
create_expander_20 = CreateExpander(UIElements=create_image_12, Header="Bituman", Open=False)
create_expander_21 = CreateExpander(UIElements=create_image_3, Header="Clay", Open=False)
create_expander_22 = CreateExpander(UIElements=merge, Header="Concrete", Open=False)
create_expander_23 = CreateExpander(UIElements=create_image_8, Header="Cement", Open=False)
create_expander_24 = CreateExpander(UIElements=[create_expander_7, create_expander_8], Header="Asphalt", Open=False)
create_expander_25 = CreateExpander(UIElements=create_image_23, Header="Aggregate", Open=False)
create_expander_26 = CreateExpander(UIElements=create_image_19, Header="Aluminum", Open=False)
merge_2 = Merge(
    Data1=create_expander_25,
    Data2=create_expander_26,
    Data3=create_expander_24,
    Data4=create_expander_20,
    Data5=create_expander_23,
    Data6=create_expander_21,
    Data7=create_expander_22,
    Data8=create_expander_19,
    Data9=create_expander_18,
    Data10=create_expander_17)
result = ClusterOutput(merge_2)

# ==== cluster MeshCorners: Finds the corners of the boundary of a mesh
M = ClusterInput()
medges = MeshEdges(Mesh=M)  # -> NakedEdges, InteriorEdges, NonManifoldEdges
join = JoinCurves(Curves=medges.NakedEdges, Preserve=False)
explode = Explode(Curve=join, Recursive=True)  # -> simplify(Segments), Vertices
shift = ShiftList(List=explode.Segments, Shift=1, Wrap=True)  # -> simplify(List)
end = EndPoints(Curve=explode.Segments)  # -> Start, End
angle = Angle(VectorA=explode.Segments, VectorB=shift)  # -> Angle, Reflex
A = ClusterInput()
smaller = SmallerThan(FirstNumber=A, SecondNumber=angle.Angle)  # -> SmallerThan, OrEqualTo
cull = CullPattern(List=end.End, CullPattern=smaller.SmallerThan)  # -> flatten(List)
L = ClusterOutput(cull)

# ==== cluster MeshItMANI11
mesh_brep = ClusterInput()
mesh_brep_2 = Geometry(simplify(mesh_brep))
group = Group(Objects=mesh_brep_2)
sortbytype = SortObjectsByType(RhinoObjects=mesh_brep_2)  # -> Points, Curves, Surfaces, Breps, Meshes, TextObjects, HatchObjects, LightObjects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
mesh = MeshBrep(
    Brep=[sortbytype.Breps, sortbytype.Extrusions, sortbytype.Surfaces],
    Settings={GridMaxCount=0, GridMinCount=16, JaggedSeams=False, MaxEdgeLength=0, MinEdgeLength=0.0001, MinTolerance=0, Refine=True, RefineAngle=0, RelativeTolerance=0.65, SimplePlanes=True, Tolerance=0})
mjoin = MeshJoin(Meshes=[sortbytype.Meshes, mesh])
unflatten = UnflattenTree(Tree=mjoin, Guide=group)
mesh_joined = Mesh(unflatten)
mesh_joined_2 = ClusterOutput(mesh_joined)

# ==== cluster Cluster_2
panel = Panel("E:\Grad School\OneDrive - Harvard University\SCI6372\logo1.png")
swatch = Red(SwatchColor=RGB(255, 255, 255))
number_slider = Slider(300, range=0..1000)
number_slider_2 = Slider(0, range=0..100)
create_image = CreateImage(ImageSource=panel, ImageWidth=300)
create_separator = CreateSeparator(Thickness="100", Horizontal=True, Color=swatch)
create_label = CreateLabel(LabelText="     Developed by: Kritika Kharbanda & Jessica Chen", LabelSize=12, Justification=0)
create_label_2 = CreateLabel(LabelText="  GSD SCI6372 / Instructor: Jonathan Grinham", LabelSize=12, Justification=0)
adjust_element_positioning = AdjustElementPositioning(
    ElementsToAdjust=create_image,
    Margin=Slider(48, range=0..100),
    AbsolutePositioning=False,
    Width=number_slider,
    HorizontalAlignment=1)
adjust_element_positioning_2 = AdjustElementPositioning(
    ElementsToAdjust=create_label,
    Margin=number_slider_2,
    AbsolutePositioning=False,
    Width=number_slider,
    HorizontalAlignment=1)
adjust_element_positioning_3 = AdjustElementPositioning(ElementsToAdjust=create_label_2, Margin=number_slider_2, AbsolutePositioning=False, HorizontalAlignment=1)
merge = Merge(Data1=create_separator, Data2=create_image, Data3=create_label, Data4=create_label_2)
result = ClusterOutput(merge)
